# Grasshopper definition LCAAnalysis_DesignTeamUser_GHInput_v3.4.gh (Grasshopper 1.0.7)

# ---- group: False Toggles When Open
panel = Panel("""BakeGeometry
ImportLayerMatchesFromExcel
ImportBuildupsFromExcel
ImportMaterialsFromExcel
CommentLCAErrors
CommentErrorsInExcel1
CommentErrorsInExcel2
CommentErrorsInExcel3
CommentErrorsInExcel4
CommentErrorsInExcel5
WriteJSON1
WriteJSON2
WriteJSON3
WriteJSON4
WriteJSON5""")
fto = FalseTogglesWhenOpen(Toggles=panel)  # inputs Toggles: list
# ---------- fto: Python ----------
"""
Sets named Boolean Toggles to False when Grasshopper file opens.
    Inputs:
        Toggles: Names of Boolean Toggles to False {list,str}
    Outputs:
    Remarks:
        Author: Anders Holden Deleuran (BIG IDEAS)
        Rhino: 6.33.20343.16431
        Version: 210202
"""

import Grasshopper as gh

ghenv.Component.Name = "FalseTogglesWhenOpen"
ghenv.Component.NickName = "FTO"

# Make persistent variable to check if GH document has opened
if "ghDocFirstOpen" not in globals():
    ghDocFirstOpen = True

# Set all named toggles to False
if Toggles and ghDocFirstOpen:
    for obj in ghenv.Component.OnPingDocument().Objects:
        if obj.NickName in Toggles:
            if type(obj) is gh.Kernel.Special.GH_BooleanToggle:
                obj.Value = False
                obj.ExpireSolution(True)
                
    # Set flag to false
    ghDocFirstOpen = False
# ---------- end fto ----------

# ---- group: Internalized Backup
builduplookupname = Text("Structure_Foundation_Concrete_Terraendaek_ETT_v0.0")
rhinolayername = Text("Foundations")
geometrytype = Text("Area")
builduplookupname_2 = Text("ElevatorShaftWall_ConcreteReinforced200mm_ConcreteFinish_221.101_ETT_v0.0")
builduplookupname_3 = Text("Roof_Flat_PretensionedConcreteLECASlab_GreenRoof_ETT_273.111_v0.0")
builduplookupname_4 = Text("Roof_Flat_PretensionedConcreteLECASlab_GreenRoof_ETT_273.111_v0.0")
builduplookupname_5 = Text("FoundationWall_CastInPlaceConcrete_ETT_v0.0")
builduplookupname_6 = Text("InternalWall_SteelFrame_Gypsum_ETT_224.101_v0.0")
rhinolayername_2 = Text("Core_ElevatorWalls")
builduplookupname_7 = Text("InternalWall_SteelFrame_Gypsum_ETT_224.101_v0.0")
builduplookupname_8 = Text("Wall_AeratedConcrete_ETT_v0.0")
rhinolayername_3 = Text("SoilRoof")
rhinolayername_4 = Text("GreenRoof")
builduplookupname_9 = Text("InternalWall_SteelFrame_Gypsum_ETT_224.101_v0.0")
rhinolayername_5 = Text("Wall_ConcreteFoundation")
rhinolayername_6 = Text("Wall_Farmacell")
geometrytype_2 = Text("Area")
builduplookupname_10 = Text("CoreWall_ConcreteReinforced400mm_ConcreteFinish_222.101_ETT_v0.0")
rhinolayername_7 = Text("Wall_apartment-corridor")
geometrytype_3 = Text("Area")
geometrytype_4 = Text("Area")
rhinolayername_8 = Text("Wall_apartment-apartment")
geometrytype_5 = Text("Area")
rhinolayername_9 = Text("Wall_AeratedConcrete")
builduplookupname_11 = Text("Facade_Aluminium_TripleLayerGlass_216.101_ETT_v0.0")
geometrytype_6 = Text("Area")
rhinolayername_10 = Text("Core_CircularWalls")
geometrytype_7 = Text("Area")
builduplookupname_12 = Text("Floor_ConcreteSlab_ETT__231.101_v0.0")
geometrytype_8 = Text("Area")
geometrytype_9 = Text("Area")
rhinolayername_11 = Text("Wall_Glass")
geometrytype_10 = Text("Area")
rhinolayername_12 = Text("Floors_typical apartments_BIGE")
builduplookupname_13 = Text("Floor_Concrete_WeberFloorFinish_ETT_239.101_v0.0")
builduplookupname_14 = Text("Roof_Flat_PretensionedConcreteLECASlab_BitumenMembrane_ETT_273.101_v0.0")
geometrytype_11 = Text("Area")
geometrytype_12 = Text("Area")
rhinolayername_13 = Text("Floors_typical apartments_Ark")
builduplookupname_15 = Text("Facade_Aluminium_OpaquePanel_ETT_v0.0")
rhinolayername_14 = Text("Roof_TowerRoof")
geometrytype_13 = Text("Area")
rhinolayername_15 = Text("Facade_Opaque")
geometrytype_14 = Text("Area")
geometrytype_15 = Text("Area")

# ----
# 2. Load Buildup Catalogue
path_to_read_json_file = Panel("L:\PROJECTS\BIGIDEAS_LCAToolDevelopment\06_3D\220905_ETTCaseStudy\Buildups\BuildupCatalogueStage3_220915-14h19m58s.json")
# 1. Read and measure Rhino Geometry
parentlayerforstudy = Panel("BIGS::ETT-Option1")
readjsontodictionary = BooleanToggle(True)
readjsontodictionary_2 = GhPythonScript(PathToReadJSONFile=path_to_read_json_file, Run=readjsontodictionary)  # -> Dictionary
# ---------- readjsontodictionary_2: Python ----------
"""
Component for reading a python dictionary from a JSON file. 
    Inputs:
        pass
    Outputs:
        pass
    Remarks:
        Author: Alexander Matthias Jacobson
        License:
        Version: 210715
"""


import Grasshopper as gh
import json
import os
import pprint
from pprint import pprint

#Initialize warning handler
warning = gh.Kernel.GH_RuntimeMessageLevel.Warning
error = gh.Kernel.GH_RuntimeMessageLevel.Error
remark = gh.Kernel.GH_RuntimeMessageLevel.Remark
dictionary = None
if Run: 
    if os.path.isfile(str(PathToReadJSONFile)) == False:
        ghenv.Component.AddRuntimeMessage(warning, 'There is no file saved in the path specified!')
    else:
        """
        # Read the JSON file
        with open(PathToReadJSONFile) as file:
            dictionary = json.load(file)
        """
        jsonFileIn = open(PathToReadJSONFile,"rb")
        dictionary = json.load(jsonFileIn)
        jsonFileIn.close()

Dictionary  = dictionary
# ---------- end readjsontodictionary_2 ----------
parentlayerforallbuildups = Text(parentlayerforstudy)
activelyupdategeometry = BooleanToggle(True)
buildupcataloguestage3 = Data(readjsontodictionary_2)
buildupcataloguestage3_2 = Data(buildupcataloguestage3)
dr = DynamicRefresh(DynamicRefresh=activelyupdategeometry)  # -> UpdateOut; inputs DynamicRefresh: Boolean
# ---------- dr: Python ----------
"""
Get Geometry on Rhino Layer. Dynamically recomputes on changes in Rhino document.
    Inputs:
        Layer: Name of Rhino layer to get Geometry from {item,str}
    Outputs:
        Geometry: Geometry that is on Rhino Layer {list,geometry}
    Remarks:
        Author: Alexander Matthias Jacobson (BIG SUSTAINABILITY)
                Based upon code written by Anders Holden Deleuran (BIG IDEAS)
        Rhino: 7.12.21299.13001
        Version: 220601
"""

ghenv.Component.Name = "Dynamic Refresh"
ghenv.Component.NickName = "DR"

import Rhino as rc
from ghpythonlib.componentbase import executingcomponent as component
import rhinoscriptsyntax as rs
import scriptcontext as sc
import time

class GetRhinoGeometry(component):
    
    runs = 0
    
    def RunScript(self, DynamicRefresh):
        
        #Set the Rhino document as the active document
        sc.doc = rc.RhinoDoc.ActiveDoc
        
        if "log" not in sc.sticky:
            sc.sticky["log"] = []
        
        # Create a key in the sticky dictionary for turning callback scheduling
        # on or off
        if "scheduleCallbackToExpireSolution" not in sc.sticky:
            sc.sticky["scheduleCallbackToExpireSolution"] = False
        
        # Start by scheduling callbacks, and assume that another component will
        # Turn this off if it is necessary
        # This line is necessary if scheduleCallbackToExpireSolution has been set
        # to false at the time of GH Documen topening
        if self.runs == 0 and sc.sticky["scheduleCallbackToExpireSolution"] is False:
            sc.sticky["scheduleCallbackToExpireSolution"] = True
        
        #sc.sticky["scheduleCallbackToExpireSolution"] = True
        #print sc.sticky["scheduleCallbackToExpireSolution"]
        
        # Add an entry to the trouble-shooting log
        sc.sticky["log"] += ['Listener at beginning sees scheduleCallbackToExpireSolution as: ' + str(sc.sticky["scheduleCallbackToExpireSolution"])]
        # print sc.sticky["log"]
        sortedList = []
        dict = {}

        # If the user requests Dynamic refresh and sticky switch is True, then schedule
        # A callback each time the document is edited
        if DynamicRefresh == True and sc.sticky["scheduleCallbackToExpireSolution"] == True:
            self.runs += 1
            self.Message = "Recomputes: " + str(self.runs)
            UpdateOut = False
            return UpdateOut
        if DynamicRefresh == False:
            UpdateOut = True
            return UpdateOut

        sc.doc = ghdoc
        
    def callBack(self,e):
        self.ExpireSolution(False)
        
    def updateComponent(self,sender,e):
        sc.sticky["log"] += ['updateComponent method was called.']
        sc.sticky["log"] += ['updateComponent read scheduleCallbackToExpireSolution read as: ' + str(sc.sticky["scheduleCallbackToExpireSolution"])]
        if sc.sticky["scheduleCallbackToExpireSolution"] == True:
            sc.sticky["log"] += ['A callback was scheduled to expire the solution.']
            self.OnPingDocument().ScheduleSolution(1,self.callBack)
            
    def __enter__(self):
        rc.RhinoDoc.AddRhinoObject += self.updateComponent
        rc.RhinoDoc.DeleteRhinoObject += self.updateComponent
        rc.RhinoDoc.UndeleteRhinoObject += self.updateComponent
        rc.RhinoDoc.ModifyObjectAttributes += self.updateComponent
        rc.RhinoDoc.LayerTableEvent += self.updateComponent
        
    def __exit__(self):
        rc.RhinoDoc.AddRhinoObject -= self.updateComponent
        rc.RhinoDoc.DeleteRhinoObject -= self.updateComponent
        rc.RhinoDoc.UndeleteRhinoObject -= self.updateComponent
        rc.RhinoDoc.ModifyObjectAttributes -= self.updateComponent
        rc.RhinoDoc.LayerTableEvent -= self.updateComponent
# ---------- end dr ----------
pathtopythoncode = FilePath("L:\PROJECTS\BIGIDEAS_LCAToolDevelopment\13_CODE-REPOSITORY\WIP\BIG-LCATool\LCAAnalysis_STEP5_ImportMeasurementsFromRhino.py")
refreshgeometry = Button()
parentlayer = Text(parentlayerforallbuildups)
file = ReadFile(File=pathtopythoncode, PerLineParse=False)
refreshgeometry_2 = Boolean(dr)
importmeasurementsfromrhino = ImportMeasurementsFromRhino(Code=file, ParentLayer=parentlayer, ChildLayersToExclude="BLOCKS", ButtonRefresh=refreshgeometry_2)  # -> Out, ParentLayerName, ChildLayerMeasurements, BoundingBoxes, GUIDsWithErrors
selectedassignmentoption = ValueList({"Option1"}, selected="Option1")
# 4. Apply Buidups To Layers
panel_2 = Panel("ETT-")
pathtopythoncode_2 = FilePath("L:\PROJECTS\BIGIDEAS_LCAToolDevelopment\13_CODE-REPOSITORY\WIP\BIG-LCATool\LCAAnalysis_STEP7_InsertStage3BuildupsIntoRhinoMeasurements.py")
value_list = ValueList({"ERROR RED": 0, "WARNING ORANGE": 1, "REMARK YELLOW": 2, "LEARNING COMMENTS": 3}, selected=["ERROR RED", "WARNING ORANGE", "REMARK YELLOW", "LEARNING COMMENTS"])
commenterrorsinexcel5 = BooleanToggle(False)
includeupstreamerrors = BooleanToggle(False)
buildupcataloguestage3_3 = Data(buildupcataloguestage3)
panel_3 = Panel(pathtopythoncode_2)
file_2 = ReadFile(File=pathtopythoncode_2, PerLineParse=False)
concat = Concatenate(FragmentA=panel_2, FragmentB=selectedassignmentoption)
designoptionname = Data(concat)
calculation_mode = ValueList({"Buildups", "EntireProjects"}, selected="EntireProjects")
calculatebuilduplcascore = BooleanToggle(True)
list = ValueList({"Use buildup service life": 0, "Use material service life": 1}, selected="Use buildup service life")
designoptionname_2 = Data(designoptionname)
# 5. Calculate Entire Project Score
pathtopythoncode_3 = FilePath("L:\PROJECTS\BIGIDEAS_LCAToolDevelopment\13_CODE-REPOSITORY\WIP\BIG-LCATool\LCAAnalysis_STEP8_CalculateLCAScore.py")
file_3 = ReadFile(File=pathtopythoncode_3, PerLineParse=False)
graphtype = ValueList({"BuildupLookupName", "BuildupRequiredInputType", "BuildupServiceLife", "LCAModule", "MaterialClassification", "MaterialDataSource", "MaterialInputType", "MaterialLookupName", "MaterialServiceLife", "RhinoLayerName", "MaterialNickName"}, selected="BuildupLookupName")
# 6. Choose graph type
pathtopythoncode_4 = FilePath("L:\PROJECTS\BIGIDEAS_LCAToolDevelopment\13_CODE-REPOSITORY\WIP\BIG-LCATool\LCAAnalysis_STEP9_CategorizeCalculationRoster.py")
file_4 = ReadFile(File=pathtopythoncode_4, PerLineParse=False)
pipeline = GeometryPipeline(
    GroupByLayer=False,
    GroupByType=False,
    IncludeHidden=True,
    IncludeLocked=True,
    LayerFilter="BIGS::ETT-Option1::Floors_typical apartments_BIGE",
    NameFilter="*",
    SublayerFiltering=True,
    TypeFilter=1073741848)
# Measure GFA
pipeline_2 = GeometryPipeline(
    GroupByLayer=False,
    GroupByType=False,
    IncludeHidden=True,
    IncludeLocked=True,
    LayerFilter="BIGS::ETT-Option1::Foundations",
    NameFilter="*",
    SublayerFiltering=True,
    TypeFilter=1073741848)
pipeline_3 = GeometryPipeline(
    GroupByLayer=False,
    GroupByType=False,
    IncludeHidden=True,
    IncludeLocked=True,
    LayerFilter="BIGS::ETT-Option1::GreenRoof",
    NameFilter="*",
    SublayerFiltering=True,
    TypeFilter=1073741848)
pipeline_4 = GeometryPipeline(
    GroupByLayer=False,
    GroupByType=False,
    IncludeHidden=True,
    IncludeLocked=True,
    LayerFilter="BIGS::ETT-Option1::Roof_TowerRoof",
    NameFilter="*",
    SublayerFiltering=True,
    TypeFilter=1073741848)
area = Area(Geometry=[pipeline, pipeline_3, pipeline_4, pipeline_2])  # -> Area, Centroid
ma = MassAddition(Input=area.Area)  # -> Result, PartialResults
list_2 = ValueList({"Calibri", "Consolas", "Corbel", "Segoe UI", "Segoe UI Semibold", "Klavika Regular", "Klavika Light", "BIG Pixel"}, selected="Klavika Regular")
# 7. Visualize LCA score in screen
projectfloorarea = Number(ma.Result)
digit_scroller = DigitScroller(Scroller_Digits=12, Scroller_Radix=9, Scroller_Value=12)
digit_scroller_2 = DigitScroller(Scroller_Digits=12, Scroller_Prefix="LegendMax", Scroller_Radix=9, Scroller_Value=19000000)
digit_scroller_3 = DigitScroller(Scroller_Digits=12, Scroller_Prefix="LegendMin", Scroller_Radix=9, Scroller_Value=-10000000)
heightinpixels = Slider(2000, range=0..2000)
widthinpixels = Slider(555, range=1..2000)
textheight = Slider(21, range=0..30)
font = Text(list_2)

# ---- group: Viewport Capture
write = Button()
vcpng = ViewportCapturePNG(Write=write)
# ---------- vcpng: Python ----------
"""
Capture the Rhino viewport to a PNG file. Places the image in a folder called
Captures in the same directory as the GH definition. Names the image the same as 
the GH defintion followed by _hourMinuteSecond. Note: Do not use this script with
the GH button as this can freeze up the canvas.
    Inputs:
        Width: Width of PNG in pixels {item,int,optional}
        Height: Height of PNG in pixels {item,int,optional}
        Grid: Capture Rhino grid {item,bool,optional}
        Axes: Capture Rhino world axes {item,bool,optional}
        Open: Opens PNG in default application {item,bool,optional}
        Write: Write the captured bitmap to PNG file {item,bool}
    Outputs:
        Path: Path of captured PNG {item,str}
    Remarks:
        Author: Anders Holden Deleuran
        License: Apache License 2.0
        Version: 201216
"""

ghenv.Component.Name = "ViewportCapturePNG"
ghenv.Component.NickName ="VCPNG"

import os
import datetime
import System
import scriptcontext as sc
import Rhino as rc

def checkOrMakeFolder():
    
    """ Check/makes a "Captures" folder in the GH def folder """
    
    if ghdoc.Path:
        folder = os.path.dirname(ghdoc.Path)
        captureFolder = folder + "\\Captures"
        if not os.path.isdir(captureFolder):
            os.makedirs(captureFolder)
        return captureFolder

def makeFileName():
    
    """ Make a string with the gh def name + current hourMinuteSecond """
    
    # Make hour minute seconds string
    n = datetime.datetime.now()
    ho,mt,sc = str(n.hour),str(n.minute),str(n.second)
    if len(ho) == 1:
        ho = "0"+ ho
    if len(mt) == 1:
        mt = "0"+mt
    if len(sc) == 1:
        sc = "0"+ sc
    hms = ho+mt+sc
    
    # Get name of GH def
    ghDef = ghenv.LocalScope.ghdoc.Name.strip("*")
    
    # Concatenate and return
    fileName = ghDef + "_" + hms
    
    return fileName

def captureActiveViewToFile(width,height,path,grid,worldAxes,cplaneAxes):
    
    """
    Captures the active view to an image file at the path. Path looks like this:
    "C:\\Users\\adel\\Desktop\\Captures\\foooo_112747.png"
    """
    
    # Get active Rhino view and set image dimensions
    sc.doc = rc.RhinoDoc.ActiveDoc
    activeView = sc.doc.Views.ActiveView
    imageDim = System.Drawing.Size(width,height)
    
    # Perform the capture
    try:
        imageCap = rc.Display.RhinoView.CaptureToBitmap(activeView,imageDim,grid,worldAxes,cplaneAxes)
        System.Drawing.Bitmap.Save(imageCap,path)
        rc.RhinoApp.WriteLine(path)
        return path
    except:
        raise Exception(" Capture failed, check the path")

# Capture
if Write:
    if not Width:
        Width = System.Windows.Forms.Screen.PrimaryScreen.WorkingArea.Width  
    if not Height:
        Height = System.Windows.Forms.Screen.PrimaryScreen.WorkingArea.Height
    capFolder = checkOrMakeFolder()
    fileName = makeFileName()
    try:
        path = os.path.join(capFolder,fileName + ".png")
        Path = captureActiveViewToFile(Width,Height,path,Grid,Axes,Grid)
        if Open:
            os.startfile(path)
    except:
        raise Exception(" Capture failed, save the GH definition")
else:
    Path = []
# ---------- end vcpng ----------

# ----
area_based_buildups = ValueList({"CoreWall_ConcreteReinforced400mm_ConcreteFinish_222.101_ETT_v0.0", "ElevatorShaftWall_ConcreteReinforced200mm_ConcreteFinish_221.101_ETT_v0.0", "ExteriorMasonry_LeccaBlocks_ETT_v0.0", "Facade_Aluminium_OpaquePanel_ETT_v0.0", "Facade_Aluminium_TripleLayerGlass_216.101_ETT_v0.0", "Floor_ConcreteSlab_ETT__231.101_v0.0", "Floor_ConcreteSlab_GenericReinforcement_v0.0", "Floor_Concrete_TileFinish_ETT_239.102_v0.0", "Floor_Concrete_WeberFloorFinish_ETT_239.101_v0.0", "FoundationWall_CastInPlaceConcrete_ETT_v0.0", "InternalWall_SteelFrame_Gypsum_ETT_224.101_v0.0", "InternalWall_SteelFrame_WetroomGypsumFinish_ETT_224.112_v0.0", "Roof_Flat_PretensionedConcreteLECASlab_BitumenMembrane_ETT_273.101_v0.0", "Roof_Flat_PretensionedConcreteLECASlab_GreenRoof_ETT_273.111_v0.0", "Structure_Foundation_Concrete_Terraendaek_ETT_v0.0", "Wall_AeratedConcrete_ETT_v0.0"}, selected="Structure_Foundation_Concrete_Terraendaek_ETT_v0.0")
# 3. Assign Buildups to Rhino layers
rhinolayername_16 = ValueList({"Foundations", "Wall_ConcreteFoundation", "Wall_AeratedConcrete", "Wall_Glass", "Wall_Farmacell", "SoilRoof", "GreenRoof", "Core_ElevatorWalls", "Core_CircularWalls", "Floors_typical apartments_BIGE", "Floors_typical apartments_Ark", "Wall_apartment-apartment", "Wall_apartment-corridor", "Facade_Opaque", "Roof_TowerRoof"}, selected="Foundations")
list_3 = ValueList({"Volume", "Area", "Length", "Count"}, selected="Area")

builduplookupname_16 = Text(area_based_buildups)
rhinolayername_17 = Text(rhinolayername_16)
geometrytype_16 = Text(list_3)

assignbuildup = GhPythonScript(RhinoLayerName=rhinolayername_17, GeometryType=geometrytype_16, BuildupToAssign=builduplookupname_16)  # -> SingleLayerAssignment
# ---------- assignbuildup: Python ----------
import Grasshopper as gh

# Initialize warning handler
warning = gh.Kernel.GH_RuntimeMessageLevel.Warning
error = gh.Kernel.GH_RuntimeMessageLevel.Error
remark = gh.Kernel.GH_RuntimeMessageLevel.Remark

inputsOk = True

# Check inputs
if not RhinoLayerName:
    message = 'Invalid input for RhinoLayerName. Please specify the Rhino layer name should receive a Buildup assignment.'
    ghenv.Component.AddRuntimeMessage(error, message)
    inputsOk = False
if not GeometryType:
    message = 'Invalid input for GeometryType. Please specify the only type of Geometry. Each layer is allowed to contain one type, and this must match the Buildup geometry type.'
    ghenv.Component.AddRuntimeMessage(error, message)
    inputsOk = False
if not BuildupToAssign:
    message = 'Invalid input for BuildupToAssign. Please specify which Buildup you would like to assign.'
    ghenv.Component.AddRuntimeMessage(error, message)
    inputsOk = False

expectedNickname = None
if GeometryType == 'Volume':
    expectedNickname = 'Volume-Based-Buildups'
if GeometryType == 'Area':
    expectedNickname = 'Area-Based-Buildups'
if GeometryType == 'Length':
    expectedNickname = 'Length-Based-Buildups'
if GeometryType == 'Count':
    expectedNickname = 'Count-Based-Buildups'

if expectedNickname is None:
    message = 'Invalid input data type for GeometryType. This must be either Volume, Area, Length or Count.'
    ghenv.Component.AddRuntimeMessage(error, message)
    inputsOk = False

# MAIN
outputDict = {}

# Collect GUIDs of all components connected to the 3rd input
valueListGUIDs = []
for component in ghenv.Component.Params.Input[2].Sources:
    valueListGUIDs.append(component.InstanceGuid)

# Scan the Grasshopper canvas for value lists with Guids in the above list
for obj in ghenv.Component.OnPingDocument().Objects:
    if type(obj) is gh.Kernel.Special.GH_ValueList:
        if obj.InstanceGuid in valueListGUIDs:
            if obj.NickName != expectedNickname:
                message = 'You have connected the an invalid list of Buildups for the Geometry type you have specified.'
                ghenv.Component.AddRuntimeMessage(error, message)
                inputsOk = False

if inputsOk:   
    outputDict = {str(RhinoLayerName) : str(BuildupToAssign)}
    
SingleLayerAssignment = [outputDict]
# ---------- end assignbuildup ----------

area_based_buildups_2 = ValueList({"CoreWall_ConcreteReinforced400mm_ConcreteFinish_222.101_ETT_v0.0", "ElevatorShaftWall_ConcreteReinforced200mm_ConcreteFinish_221.101_ETT_v0.0", "ExteriorMasonry_LeccaBlocks_ETT_v0.0", "Facade_Aluminium_OpaquePanel_ETT_v0.0", "Facade_Aluminium_TripleLayerGlass_216.101_ETT_v0.0", "Floor_ConcreteSlab_ETT__231.101_v0.0", "Floor_ConcreteSlab_GenericReinforcement_v0.0", "Floor_Concrete_TileFinish_ETT_239.102_v0.0", "Floor_Concrete_WeberFloorFinish_ETT_239.101_v0.0", "FoundationWall_CastInPlaceConcrete_ETT_v0.0", "InternalWall_SteelFrame_Gypsum_ETT_224.101_v0.0", "InternalWall_SteelFrame_WetroomGypsumFinish_ETT_224.112_v0.0", "Roof_Flat_PretensionedConcreteLECASlab_BitumenMembrane_ETT_273.101_v0.0", "Roof_Flat_PretensionedConcreteLECASlab_GreenRoof_ETT_273.111_v0.0", "Structure_Foundation_Concrete_Terraendaek_ETT_v0.0", "Wall_AeratedConcrete_ETT_v0.0"}, selected="ElevatorShaftWall_ConcreteReinforced200mm_ConcreteFinish_221.101_ETT_v0.0")
rhinolayername_18 = ValueList({"Foundations", "Wall_ConcreteFoundation", "Wall_AeratedConcrete", "Wall_Glass", "Wall_Farmacell", "SoilRoof", "GreenRoof", "Core_ElevatorWalls", "Core_CircularWalls", "Floors_typical apartments_BIGE", "Floors_typical apartments_Ark", "Wall_apartment-apartment", "Wall_apartment-corridor", "Facade_Opaque", "Roof_TowerRoof"}, selected="Foundations")
list_4 = ValueList({"Volume", "Area", "Length", "Count"}, selected="Area")

builduplookupname_17 = Text(area_based_buildups_2)
rhinolayername_19 = Text(rhinolayername_18)
geometrytype_17 = Text(list_4)

assignbuildup_2 = GhPythonScript(RhinoLayerName=rhinolayername_19, GeometryType=geometrytype_17, BuildupToAssign=builduplookupname_17)  # -> SingleLayerAssignment; same code as assignbuildup

area_based_buildups_3 = ValueList({"CoreWall_ConcreteReinforced400mm_ConcreteFinish_222.101_ETT_v0.0", "ElevatorShaftWall_ConcreteReinforced200mm_ConcreteFinish_221.101_ETT_v0.0", "ExteriorMasonry_LeccaBlocks_ETT_v0.0", "Facade_Aluminium_OpaquePanel_ETT_v0.0", "Facade_Aluminium_TripleLayerGlass_216.101_ETT_v0.0", "Floor_ConcreteSlab_ETT__231.101_v0.0", "Floor_ConcreteSlab_GenericReinforcement_v0.0", "Floor_Concrete_TileFinish_ETT_239.102_v0.0", "Floor_Concrete_WeberFloorFinish_ETT_239.101_v0.0", "FoundationWall_CastInPlaceConcrete_ETT_v0.0", "InternalWall_SteelFrame_Gypsum_ETT_224.101_v0.0", "InternalWall_SteelFrame_WetroomGypsumFinish_ETT_224.112_v0.0", "Roof_Flat_PretensionedConcreteLECASlab_BitumenMembrane_ETT_273.101_v0.0", "Roof_Flat_PretensionedConcreteLECASlab_GreenRoof_ETT_273.111_v0.0", "Structure_Foundation_Concrete_Terraendaek_ETT_v0.0", "Wall_AeratedConcrete_ETT_v0.0"}, selected="InternalWall_SteelFrame_Gypsum_ETT_224.101_v0.0")
rhinolayername_20 = ValueList({"Foundations", "Wall_ConcreteFoundation", "Wall_AeratedConcrete", "Wall_Glass", "Wall_Farmacell", "SoilRoof", "GreenRoof", "Core_ElevatorWalls", "Core_CircularWalls", "Floors_typical apartments_BIGE", "Floors_typical apartments_Ark", "Wall_apartment-apartment", "Wall_apartment-corridor", "Facade_Opaque", "Roof_TowerRoof"}, selected="Foundations")
list_5 = ValueList({"Volume", "Area", "Length", "Count"}, selected="Area")

builduplookupname_18 = Text(area_based_buildups_3)
rhinolayername_21 = Text(rhinolayername_20)
geometrytype_18 = Text(list_5)

assignbuildup_3 = GhPythonScript(RhinoLayerName=rhinolayername_21, GeometryType=geometrytype_18, BuildupToAssign=builduplookupname_18)  # -> SingleLayerAssignment; same code as assignbuildup

area_based_buildups_4 = ValueList({"CoreWall_ConcreteReinforced400mm_ConcreteFinish_222.101_ETT_v0.0", "ElevatorShaftWall_ConcreteReinforced200mm_ConcreteFinish_221.101_ETT_v0.0", "ExteriorMasonry_LeccaBlocks_ETT_v0.0", "Facade_Aluminium_OpaquePanel_ETT_v0.0", "Facade_Aluminium_TripleLayerGlass_216.101_ETT_v0.0", "Floor_ConcreteSlab_ETT__231.101_v0.0", "Floor_ConcreteSlab_GenericReinforcement_v0.0", "Floor_Concrete_TileFinish_ETT_239.102_v0.0", "Floor_Concrete_WeberFloorFinish_ETT_239.101_v0.0", "FoundationWall_CastInPlaceConcrete_ETT_v0.0", "InternalWall_SteelFrame_Gypsum_ETT_224.101_v0.0", "InternalWall_SteelFrame_WetroomGypsumFinish_ETT_224.112_v0.0", "Roof_Flat_PretensionedConcreteLECASlab_BitumenMembrane_ETT_273.101_v0.0", "Roof_Flat_PretensionedConcreteLECASlab_GreenRoof_ETT_273.111_v0.0", "Structure_Foundation_Concrete_Terraendaek_ETT_v0.0", "Wall_AeratedConcrete_ETT_v0.0"}, selected="Roof_Flat_PretensionedConcreteLECASlab_GreenRoof_ETT_273.111_v0.0")
rhinolayername_22 = ValueList({"Foundations", "Wall_ConcreteFoundation", "Wall_AeratedConcrete", "Wall_Glass", "Wall_Farmacell", "SoilRoof", "GreenRoof", "Core_ElevatorWalls", "Core_CircularWalls", "Floors_typical apartments_BIGE", "Floors_typical apartments_Ark", "Wall_apartment-apartment", "Wall_apartment-corridor", "Facade_Opaque", "Roof_TowerRoof"}, selected="Foundations")
list_6 = ValueList({"Volume", "Area", "Length", "Count"}, selected="Area")

builduplookupname_19 = Text(area_based_buildups_4)
rhinolayername_23 = Text(rhinolayername_22)
geometrytype_19 = Text(list_6)

assignbuildup_4 = GhPythonScript(RhinoLayerName=rhinolayername_23, GeometryType=geometrytype_19, BuildupToAssign=builduplookupname_19)  # -> SingleLayerAssignment; same code as assignbuildup

area_based_buildups_5 = ValueList({"CoreWall_ConcreteReinforced400mm_ConcreteFinish_222.101_ETT_v0.0", "ElevatorShaftWall_ConcreteReinforced200mm_ConcreteFinish_221.101_ETT_v0.0", "ExteriorMasonry_LeccaBlocks_ETT_v0.0", "Facade_Aluminium_OpaquePanel_ETT_v0.0", "Facade_Aluminium_TripleLayerGlass_216.101_ETT_v0.0", "Floor_ConcreteSlab_ETT__231.101_v0.0", "Floor_ConcreteSlab_GenericReinforcement_v0.0", "Floor_Concrete_TileFinish_ETT_239.102_v0.0", "Floor_Concrete_WeberFloorFinish_ETT_239.101_v0.0", "FoundationWall_CastInPlaceConcrete_ETT_v0.0", "InternalWall_SteelFrame_Gypsum_ETT_224.101_v0.0", "InternalWall_SteelFrame_WetroomGypsumFinish_ETT_224.112_v0.0", "Roof_Flat_PretensionedConcreteLECASlab_BitumenMembrane_ETT_273.101_v0.0", "Roof_Flat_PretensionedConcreteLECASlab_GreenRoof_ETT_273.111_v0.0", "Structure_Foundation_Concrete_Terraendaek_ETT_v0.0", "Wall_AeratedConcrete_ETT_v0.0"}, selected="Roof_Flat_PretensionedConcreteLECASlab_GreenRoof_ETT_273.111_v0.0")
rhinolayername_24 = ValueList({"Foundations", "Wall_ConcreteFoundation", "Wall_AeratedConcrete", "Wall_Glass", "Wall_Farmacell", "SoilRoof", "GreenRoof", "Core_ElevatorWalls", "Core_CircularWalls", "Floors_typical apartments_BIGE", "Floors_typical apartments_Ark", "Wall_apartment-apartment", "Wall_apartment-corridor", "Facade_Opaque", "Roof_TowerRoof"}, selected="Foundations")
list_7 = ValueList({"Volume", "Area", "Length", "Count"}, selected="Area")

builduplookupname_20 = Text(area_based_buildups_5)
rhinolayername_25 = Text(rhinolayername_24)
geometrytype_20 = Text(list_7)

assignbuildup_5 = GhPythonScript(RhinoLayerName=rhinolayername_25, GeometryType=geometrytype_20, BuildupToAssign=builduplookupname_20)  # -> SingleLayerAssignment; same code as assignbuildup

area_based_buildups_6 = ValueList({"CoreWall_ConcreteReinforced400mm_ConcreteFinish_222.101_ETT_v0.0", "ElevatorShaftWall_ConcreteReinforced200mm_ConcreteFinish_221.101_ETT_v0.0", "ExteriorMasonry_LeccaBlocks_ETT_v0.0", "Facade_Aluminium_OpaquePanel_ETT_v0.0", "Facade_Aluminium_TripleLayerGlass_216.101_ETT_v0.0", "Floor_ConcreteSlab_ETT__231.101_v0.0", "Floor_ConcreteSlab_GenericReinforcement_v0.0", "Floor_Concrete_TileFinish_ETT_239.102_v0.0", "Floor_Concrete_WeberFloorFinish_ETT_239.101_v0.0", "FoundationWall_CastInPlaceConcrete_ETT_v0.0", "InternalWall_SteelFrame_Gypsum_ETT_224.101_v0.0", "InternalWall_SteelFrame_WetroomGypsumFinish_ETT_224.112_v0.0", "Roof_Flat_PretensionedConcreteLECASlab_BitumenMembrane_ETT_273.101_v0.0", "Roof_Flat_PretensionedConcreteLECASlab_GreenRoof_ETT_273.111_v0.0", "Structure_Foundation_Concrete_Terraendaek_ETT_v0.0", "Wall_AeratedConcrete_ETT_v0.0"}, selected="InternalWall_SteelFrame_Gypsum_ETT_224.101_v0.0")
rhinolayername_26 = ValueList({"Foundations", "Wall_ConcreteFoundation", "Wall_AeratedConcrete", "Wall_Glass", "Wall_Farmacell", "SoilRoof", "GreenRoof", "Core_ElevatorWalls", "Core_CircularWalls", "Floors_typical apartments_BIGE", "Floors_typical apartments_Ark", "Wall_apartment-apartment", "Wall_apartment-corridor", "Facade_Opaque", "Roof_TowerRoof"}, selected="Foundations")
list_8 = ValueList({"Volume", "Area", "Length", "Count"}, selected="Area")

builduplookupname_21 = Text(area_based_buildups_6)
rhinolayername_27 = Text(rhinolayername_26)
geometrytype_21 = Text(list_8)

assignbuildup_6 = GhPythonScript(RhinoLayerName=rhinolayername_27, GeometryType=geometrytype_21, BuildupToAssign=builduplookupname_21)  # -> SingleLayerAssignment; same code as assignbuildup

area_based_buildups_7 = ValueList({"CoreWall_ConcreteReinforced400mm_ConcreteFinish_222.101_ETT_v0.0", "ElevatorShaftWall_ConcreteReinforced200mm_ConcreteFinish_221.101_ETT_v0.0", "ExteriorMasonry_LeccaBlocks_ETT_v0.0", "Facade_Aluminium_OpaquePanel_ETT_v0.0", "Facade_Aluminium_TripleLayerGlass_216.101_ETT_v0.0", "Floor_ConcreteSlab_ETT__231.101_v0.0", "Floor_ConcreteSlab_GenericReinforcement_v0.0", "Floor_Concrete_TileFinish_ETT_239.102_v0.0", "Floor_Concrete_WeberFloorFinish_ETT_239.101_v0.0", "FoundationWall_CastInPlaceConcrete_ETT_v0.0", "InternalWall_SteelFrame_Gypsum_ETT_224.101_v0.0", "InternalWall_SteelFrame_WetroomGypsumFinish_ETT_224.112_v0.0", "Roof_Flat_PretensionedConcreteLECASlab_BitumenMembrane_ETT_273.101_v0.0", "Roof_Flat_PretensionedConcreteLECASlab_GreenRoof_ETT_273.111_v0.0", "Structure_Foundation_Concrete_Terraendaek_ETT_v0.0", "Wall_AeratedConcrete_ETT_v0.0"}, selected="FoundationWall_CastInPlaceConcrete_ETT_v0.0")
rhinolayername_28 = ValueList({"Foundations", "Wall_ConcreteFoundation", "Wall_AeratedConcrete", "Wall_Glass", "Wall_Farmacell", "SoilRoof", "GreenRoof", "Core_ElevatorWalls", "Core_CircularWalls", "Floors_typical apartments_BIGE", "Floors_typical apartments_Ark", "Wall_apartment-apartment", "Wall_apartment-corridor", "Facade_Opaque", "Roof_TowerRoof"}, selected="Foundations")
list_9 = ValueList({"Volume", "Area", "Length", "Count"}, selected="Volume")

rhinolayername_29 = Text(rhinolayername_28)
geometrytype_22 = Text(list_9)
builduplookupname_22 = Text(area_based_buildups_7)

assignbuildup_7 = GhPythonScript(RhinoLayerName=rhinolayername_29, GeometryType=geometrytype_22, BuildupToAssign=builduplookupname_22)  # -> SingleLayerAssignment
# ---------- assignbuildup_7: Python ----------
import Grasshopper as gh

# Initialize warning handler
warning = gh.Kernel.GH_RuntimeMessageLevel.Warning
error = gh.Kernel.GH_RuntimeMessageLevel.Error
remark = gh.Kernel.GH_RuntimeMessageLevel.Remark

inputsOk = True

# Check inputs
if not RhinoLayerName:
    message = 'Invalid input for RhinoLayerName. Please specify the Rhino layer name should receive a Buildup assignment.'
    ghenv.Component.AddRuntimeMessage(error, message)
    inputsOk = False
if not GeometryType:
    message = 'Invalid input for GeometryType. Please specify the only type of Geometry. Each layer is allowed to contain one type, and this must match the Buildup geometry type.'
    ghenv.Component.AddRuntimeMessage(error, message)
    inputsOk = False
if not BuildupToAssign:
    message = 'Invalid input for BuildupToAssign. Please specify which Buildup you would like to assign.'
    ghenv.Component.AddRuntimeMessage(error, message)
    inputsOk = False

expectedNickname = None
if GeometryType == 'Volume':
    expectedNickname = 'Volume-Based-Buildups'
if GeometryType == 'Area':
    expectedNickname = 'Area-Based-Buildups'
if GeometryType == 'Length':
    expectedNickname = 'Length-Based-Buildups'
if GeometryType == 'Count':
    expectedNickname = 'Count-Based-Buildups'

if expectedNickname is None:
    message = 'Invalid input data type for GeometryType. This must be either Volume, Area, Length or Count.'
    ghenv.Component.AddRuntimeMessage(error, message)
    inputsOk = False

# MAIN
outputDict = {}

# Collect GUIDs of all components connected to the 3rd input
valueListGUIDs = []
for component in ghenv.Component.Params.Input[2].Sources:
    valueListGUIDs.append(component.InstanceGuid)

# Scan the Grasshopper canvas for value lists with Guids in the above list
for obj in ghenv.Component.OnPingDocument().Objects:
    if type(obj) is gh.Kernel.Special.GH_ValueList:
        if obj.InstanceGuid in valueListGUIDs:
            # Now that we found a value list in the canvas we check to see if it's nickname equals the expected nickname
            # If it does not we throw an error.
            if obj.NickName != expectedNickname:
                message = 'You have connected the an invalid list of Buildups for the Geometry type you have specified.'
                ghenv.Component.AddRuntimeMessage(error, message)
                inputsOk = False

if inputsOk:   
    outputDict = {str(RhinoLayerName) : str(BuildupToAssign)}
    
SingleLayerAssignment = [outputDict]
# ---------- end assignbuildup_7 ----------

area_based_buildups_8 = ValueList({"CoreWall_ConcreteReinforced400mm_ConcreteFinish_222.101_ETT_v0.0", "ElevatorShaftWall_ConcreteReinforced200mm_ConcreteFinish_221.101_ETT_v0.0", "ExteriorMasonry_LeccaBlocks_ETT_v0.0", "Facade_Aluminium_OpaquePanel_ETT_v0.0", "Facade_Aluminium_TripleLayerGlass_216.101_ETT_v0.0", "Floor_ConcreteSlab_ETT__231.101_v0.0", "Floor_ConcreteSlab_GenericReinforcement_v0.0", "Floor_Concrete_TileFinish_ETT_239.102_v0.0", "Floor_Concrete_WeberFloorFinish_ETT_239.101_v0.0", "FoundationWall_CastInPlaceConcrete_ETT_v0.0", "InternalWall_SteelFrame_Gypsum_ETT_224.101_v0.0", "InternalWall_SteelFrame_WetroomGypsumFinish_ETT_224.112_v0.0", "Roof_Flat_PretensionedConcreteLECASlab_BitumenMembrane_ETT_273.101_v0.0", "Roof_Flat_PretensionedConcreteLECASlab_GreenRoof_ETT_273.111_v0.0", "Structure_Foundation_Concrete_Terraendaek_ETT_v0.0", "Wall_AeratedConcrete_ETT_v0.0"}, selected="InternalWall_SteelFrame_Gypsum_ETT_224.101_v0.0")
rhinolayername_30 = ValueList({"Foundations", "Wall_ConcreteFoundation", "Wall_AeratedConcrete", "Wall_Glass", "Wall_Farmacell", "SoilRoof", "GreenRoof", "Core_ElevatorWalls", "Core_CircularWalls", "Floors_typical apartments_BIGE", "Floors_typical apartments_Ark", "Wall_apartment-apartment", "Wall_apartment-corridor", "Facade_Opaque", "Roof_TowerRoof"}, selected="Foundations")
list_10 = ValueList({"Volume", "Area", "Length", "Count"}, selected="Area")

builduplookupname_23 = Text(area_based_buildups_8)
rhinolayername_31 = Text(rhinolayername_30)
geometrytype_23 = Text(list_10)

assignbuildup_8 = GhPythonScript(RhinoLayerName=rhinolayername_31, GeometryType=geometrytype_23, BuildupToAssign=builduplookupname_23)  # -> SingleLayerAssignment; same code as assignbuildup

area_based_buildups_9 = ValueList({"CoreWall_ConcreteReinforced400mm_ConcreteFinish_222.101_ETT_v0.0", "ElevatorShaftWall_ConcreteReinforced200mm_ConcreteFinish_221.101_ETT_v0.0", "ExteriorMasonry_LeccaBlocks_ETT_v0.0", "Facade_Aluminium_OpaquePanel_ETT_v0.0", "Facade_Aluminium_TripleLayerGlass_216.101_ETT_v0.0", "Floor_ConcreteSlab_ETT__231.101_v0.0", "Floor_ConcreteSlab_GenericReinforcement_v0.0", "Floor_Concrete_TileFinish_ETT_239.102_v0.0", "Floor_Concrete_WeberFloorFinish_ETT_239.101_v0.0", "FoundationWall_CastInPlaceConcrete_ETT_v0.0", "InternalWall_SteelFrame_Gypsum_ETT_224.101_v0.0", "InternalWall_SteelFrame_WetroomGypsumFinish_ETT_224.112_v0.0", "Roof_Flat_PretensionedConcreteLECASlab_BitumenMembrane_ETT_273.101_v0.0", "Roof_Flat_PretensionedConcreteLECASlab_GreenRoof_ETT_273.111_v0.0", "Structure_Foundation_Concrete_Terraendaek_ETT_v0.0", "Wall_AeratedConcrete_ETT_v0.0"}, selected="CoreWall_ConcreteReinforced400mm_ConcreteFinish_222.101_ETT_v0.0")
rhinolayername_32 = ValueList({"Foundations", "Wall_ConcreteFoundation", "Wall_AeratedConcrete", "Wall_Glass", "Wall_Farmacell", "SoilRoof", "GreenRoof", "Core_ElevatorWalls", "Core_CircularWalls", "Floors_typical apartments_BIGE", "Floors_typical apartments_Ark", "Wall_apartment-apartment", "Wall_apartment-corridor", "Facade_Opaque", "Roof_TowerRoof"}, selected="Foundations")
list_11 = ValueList({"Volume", "Area", "Length", "Count"}, selected="Area")

builduplookupname_24 = Text(area_based_buildups_9)
rhinolayername_33 = Text(rhinolayername_32)
geometrytype_24 = Text(list_11)

assignbuildup_9 = GhPythonScript(RhinoLayerName=rhinolayername_33, GeometryType=geometrytype_24, BuildupToAssign=builduplookupname_24)  # -> SingleLayerAssignment; same code as assignbuildup

area_based_buildups_10 = ValueList({"CoreWall_ConcreteReinforced400mm_ConcreteFinish_222.101_ETT_v0.0", "ElevatorShaftWall_ConcreteReinforced200mm_ConcreteFinish_221.101_ETT_v0.0", "ExteriorMasonry_LeccaBlocks_ETT_v0.0", "Facade_Aluminium_OpaquePanel_ETT_v0.0", "Facade_Aluminium_TripleLayerGlass_216.101_ETT_v0.0", "Floor_ConcreteSlab_ETT__231.101_v0.0", "Floor_ConcreteSlab_GenericReinforcement_v0.0", "Floor_Concrete_TileFinish_ETT_239.102_v0.0", "Floor_Concrete_WeberFloorFinish_ETT_239.101_v0.0", "FoundationWall_CastInPlaceConcrete_ETT_v0.0", "InternalWall_SteelFrame_Gypsum_ETT_224.101_v0.0", "InternalWall_SteelFrame_WetroomGypsumFinish_ETT_224.112_v0.0", "Roof_Flat_PretensionedConcreteLECASlab_BitumenMembrane_ETT_273.101_v0.0", "Roof_Flat_PretensionedConcreteLECASlab_GreenRoof_ETT_273.111_v0.0", "Structure_Foundation_Concrete_Terraendaek_ETT_v0.0", "Wall_AeratedConcrete_ETT_v0.0"}, selected="Wall_AeratedConcrete_ETT_v0.0")
rhinolayername_34 = ValueList({"Foundations", "Wall_ConcreteFoundation", "Wall_AeratedConcrete", "Wall_Glass", "Wall_Farmacell", "SoilRoof", "GreenRoof", "Core_ElevatorWalls", "Core_CircularWalls", "Floors_typical apartments_BIGE", "Floors_typical apartments_Ark", "Wall_apartment-apartment", "Wall_apartment-corridor", "Facade_Opaque", "Roof_TowerRoof"}, selected="Foundations")
list_12 = ValueList({"Volume", "Area", "Length", "Count"}, selected="Area")

builduplookupname_25 = Text(area_based_buildups_10)
rhinolayername_35 = Text(rhinolayername_34)
geometrytype_25 = Text(list_12)

assignbuildup_10 = GhPythonScript(RhinoLayerName=rhinolayername_35, GeometryType=geometrytype_25, BuildupToAssign=builduplookupname_25)  # -> SingleLayerAssignment; same code as assignbuildup

area_based_buildups_11 = ValueList({"CoreWall_ConcreteReinforced400mm_ConcreteFinish_222.101_ETT_v0.0", "ElevatorShaftWall_ConcreteReinforced200mm_ConcreteFinish_221.101_ETT_v0.0", "ExteriorMasonry_LeccaBlocks_ETT_v0.0", "Facade_Aluminium_OpaquePanel_ETT_v0.0", "Facade_Aluminium_TripleLayerGlass_216.101_ETT_v0.0", "Floor_ConcreteSlab_ETT__231.101_v0.0", "Floor_ConcreteSlab_GenericReinforcement_v0.0", "Floor_Concrete_TileFinish_ETT_239.102_v0.0", "Floor_Concrete_WeberFloorFinish_ETT_239.101_v0.0", "FoundationWall_CastInPlaceConcrete_ETT_v0.0", "InternalWall_SteelFrame_Gypsum_ETT_224.101_v0.0", "InternalWall_SteelFrame_WetroomGypsumFinish_ETT_224.112_v0.0", "Roof_Flat_PretensionedConcreteLECASlab_BitumenMembrane_ETT_273.101_v0.0", "Roof_Flat_PretensionedConcreteLECASlab_GreenRoof_ETT_273.111_v0.0", "Structure_Foundation_Concrete_Terraendaek_ETT_v0.0", "Wall_AeratedConcrete_ETT_v0.0"}, selected="Floor_ConcreteSlab_GenericReinforcement_v0.0")
rhinolayername_36 = ValueList({"Foundations", "Wall_ConcreteFoundation", "Wall_AeratedConcrete", "Wall_Glass", "Wall_Farmacell", "SoilRoof", "GreenRoof", "Core_ElevatorWalls", "Core_CircularWalls", "Floors_typical apartments_BIGE", "Floors_typical apartments_Ark", "Wall_apartment-apartment", "Wall_apartment-corridor", "Facade_Opaque", "Roof_TowerRoof"}, selected="Foundations")
list_13 = ValueList({"Volume", "Area", "Length", "Count"}, selected="Area")

builduplookupname_26 = Text(area_based_buildups_11)
rhinolayername_37 = Text(rhinolayername_36)
geometrytype_26 = Text(list_13)

assignbuildup_11 = GhPythonScript(RhinoLayerName=rhinolayername_37, GeometryType=geometrytype_26, BuildupToAssign=builduplookupname_26)  # -> SingleLayerAssignment; same code as assignbuildup

area_based_buildups_12 = ValueList({"CoreWall_ConcreteReinforced400mm_ConcreteFinish_222.101_ETT_v0.0", "ElevatorShaftWall_ConcreteReinforced200mm_ConcreteFinish_221.101_ETT_v0.0", "ExteriorMasonry_LeccaBlocks_ETT_v0.0", "Facade_Aluminium_OpaquePanel_ETT_v0.0", "Facade_Aluminium_TripleLayerGlass_216.101_ETT_v0.0", "Floor_ConcreteSlab_ETT__231.101_v0.0", "Floor_ConcreteSlab_GenericReinforcement_v0.0", "Floor_Concrete_TileFinish_ETT_239.102_v0.0", "Floor_Concrete_WeberFloorFinish_ETT_239.101_v0.0", "FoundationWall_CastInPlaceConcrete_ETT_v0.0", "InternalWall_SteelFrame_Gypsum_ETT_224.101_v0.0", "InternalWall_SteelFrame_WetroomGypsumFinish_ETT_224.112_v0.0", "Roof_Flat_PretensionedConcreteLECASlab_BitumenMembrane_ETT_273.101_v0.0", "Roof_Flat_PretensionedConcreteLECASlab_GreenRoof_ETT_273.111_v0.0", "Structure_Foundation_Concrete_Terraendaek_ETT_v0.0", "Wall_AeratedConcrete_ETT_v0.0"}, selected="CoreWall_ConcreteReinforced400mm_ConcreteFinish_222.101_ETT_v0.0")
rhinolayername_38 = ValueList({"Foundations", "Wall_ConcreteFoundation", "Wall_AeratedConcrete", "Wall_Glass", "Wall_Farmacell", "SoilRoof", "GreenRoof", "Core_ElevatorWalls", "Core_CircularWalls", "Floors_typical apartments_BIGE", "Floors_typical apartments_Ark", "Wall_apartment-apartment", "Wall_apartment-corridor", "Facade_Opaque", "Roof_TowerRoof"}, selected="Foundations")
list_14 = ValueList({"Volume", "Area", "Length", "Count"}, selected="Area")

builduplookupname_27 = Text(area_based_buildups_12)
rhinolayername_39 = Text(rhinolayername_38)
geometrytype_27 = Text(list_14)

assignbuildup_12 = GhPythonScript(RhinoLayerName=rhinolayername_39, GeometryType=geometrytype_27, BuildupToAssign=builduplookupname_27)  # -> SingleLayerAssignment; same code as assignbuildup

area_based_buildups_13 = ValueList({"CoreWall_ConcreteReinforced400mm_ConcreteFinish_222.101_ETT_v0.0", "ElevatorShaftWall_ConcreteReinforced200mm_ConcreteFinish_221.101_ETT_v0.0", "ExteriorMasonry_LeccaBlocks_ETT_v0.0", "Facade_Aluminium_OpaquePanel_ETT_v0.0", "Facade_Aluminium_TripleLayerGlass_216.101_ETT_v0.0", "Floor_ConcreteSlab_ETT__231.101_v0.0", "Floor_ConcreteSlab_GenericReinforcement_v0.0", "Floor_Concrete_TileFinish_ETT_239.102_v0.0", "Floor_Concrete_WeberFloorFinish_ETT_239.101_v0.0", "FoundationWall_CastInPlaceConcrete_ETT_v0.0", "InternalWall_SteelFrame_Gypsum_ETT_224.101_v0.0", "InternalWall_SteelFrame_WetroomGypsumFinish_ETT_224.112_v0.0", "Roof_Flat_PretensionedConcreteLECASlab_BitumenMembrane_ETT_273.101_v0.0", "Roof_Flat_PretensionedConcreteLECASlab_GreenRoof_ETT_273.111_v0.0", "Structure_Foundation_Concrete_Terraendaek_ETT_v0.0", "Wall_AeratedConcrete_ETT_v0.0"}, selected="Facade_Aluminium_TripleLayerGlass_216.101_ETT_v0.0")
rhinolayername_40 = ValueList({"Foundations", "Wall_ConcreteFoundation", "Wall_AeratedConcrete", "Wall_Glass", "Wall_Farmacell", "SoilRoof", "GreenRoof", "Core_ElevatorWalls", "Core_CircularWalls", "Floors_typical apartments_BIGE", "Floors_typical apartments_Ark", "Wall_apartment-apartment", "Wall_apartment-corridor", "Facade_Opaque", "Roof_TowerRoof"}, selected="Foundations")
list_15 = ValueList({"Volume", "Area", "Length", "Count"}, selected="Area")

builduplookupname_28 = Text(area_based_buildups_13)
rhinolayername_41 = Text(rhinolayername_40)
geometrytype_28 = Text(list_15)

assignbuildup_13 = GhPythonScript(RhinoLayerName=rhinolayername_41, GeometryType=geometrytype_28, BuildupToAssign=builduplookupname_28)  # -> SingleLayerAssignment; same code as assignbuildup

area_based_buildups_14 = ValueList({"CoreWall_ConcreteReinforced400mm_ConcreteFinish_222.101_ETT_v0.0", "ElevatorShaftWall_ConcreteReinforced200mm_ConcreteFinish_221.101_ETT_v0.0", "ExteriorMasonry_LeccaBlocks_ETT_v0.0", "Facade_Aluminium_OpaquePanel_ETT_v0.0", "Facade_Aluminium_TripleLayerGlass_216.101_ETT_v0.0", "Floor_ConcreteSlab_ETT__231.101_v0.0", "Floor_ConcreteSlab_GenericReinforcement_v0.0", "Floor_Concrete_TileFinish_ETT_239.102_v0.0", "Floor_Concrete_WeberFloorFinish_ETT_239.101_v0.0", "FoundationWall_CastInPlaceConcrete_ETT_v0.0", "InternalWall_SteelFrame_Gypsum_ETT_224.101_v0.0", "InternalWall_SteelFrame_WetroomGypsumFinish_ETT_224.112_v0.0", "Roof_Flat_PretensionedConcreteLECASlab_BitumenMembrane_ETT_273.101_v0.0", "Roof_Flat_PretensionedConcreteLECASlab_GreenRoof_ETT_273.111_v0.0", "Structure_Foundation_Concrete_Terraendaek_ETT_v0.0", "Wall_AeratedConcrete_ETT_v0.0"}, selected="Floor_Concrete_WeberFloorFinish_ETT_239.101_v0.0")
rhinolayername_42 = ValueList({"Foundations", "Wall_ConcreteFoundation", "Wall_AeratedConcrete", "Wall_Glass", "Wall_Farmacell", "SoilRoof", "GreenRoof", "Core_ElevatorWalls", "Core_CircularWalls", "Floors_typical apartments_BIGE", "Floors_typical apartments_Ark", "Wall_apartment-apartment", "Wall_apartment-corridor", "Facade_Opaque", "Roof_TowerRoof"}, selected="Foundations")
list_16 = ValueList({"Volume", "Area", "Length", "Count"}, selected="Area")

builduplookupname_29 = Text(area_based_buildups_14)
rhinolayername_43 = Text(rhinolayername_42)
geometrytype_29 = Text(list_16)

assignbuildup_14 = GhPythonScript(RhinoLayerName=rhinolayername_43, GeometryType=geometrytype_29, BuildupToAssign=builduplookupname_29)  # -> SingleLayerAssignment; same code as assignbuildup

area_based_buildups_15 = ValueList({"CoreWall_ConcreteReinforced400mm_ConcreteFinish_222.101_ETT_v0.0", "ElevatorShaftWall_ConcreteReinforced200mm_ConcreteFinish_221.101_ETT_v0.0", "ExteriorMasonry_LeccaBlocks_ETT_v0.0", "Facade_Aluminium_OpaquePanel_ETT_v0.0", "Facade_Aluminium_TripleLayerGlass_216.101_ETT_v0.0", "Floor_ConcreteSlab_ETT__231.101_v0.0", "Floor_ConcreteSlab_GenericReinforcement_v0.0", "Floor_Concrete_TileFinish_ETT_239.102_v0.0", "Floor_Concrete_WeberFloorFinish_ETT_239.101_v0.0", "FoundationWall_CastInPlaceConcrete_ETT_v0.0", "InternalWall_SteelFrame_Gypsum_ETT_224.101_v0.0", "InternalWall_SteelFrame_WetroomGypsumFinish_ETT_224.112_v0.0", "Roof_Flat_PretensionedConcreteLECASlab_BitumenMembrane_ETT_273.101_v0.0", "Roof_Flat_PretensionedConcreteLECASlab_GreenRoof_ETT_273.111_v0.0", "Structure_Foundation_Concrete_Terraendaek_ETT_v0.0", "Wall_AeratedConcrete_ETT_v0.0"}, selected="CoreWall_ConcreteReinforced400mm_ConcreteFinish_222.101_ETT_v0.0")
rhinolayername_44 = ValueList({"Foundations", "Wall_ConcreteFoundation", "Wall_AeratedConcrete", "Wall_Glass", "Wall_Farmacell", "SoilRoof", "GreenRoof", "Core_ElevatorWalls", "Core_CircularWalls", "Floors_typical apartments_BIGE", "Floors_typical apartments_Ark", "Wall_apartment-apartment", "Wall_apartment-corridor", "Facade_Opaque", "Roof_TowerRoof"}, selected="Foundations")
list_17 = ValueList({"Volume", "Area", "Length", "Count"}, selected="Area")

builduplookupname_30 = Text(area_based_buildups_15)
rhinolayername_45 = Text(rhinolayername_44)
geometrytype_30 = Text(list_17)

assignbuildup_15 = GhPythonScript(RhinoLayerName=rhinolayername_45, GeometryType=geometrytype_30, BuildupToAssign=builduplookupname_30)  # -> SingleLayerAssignment; same code as assignbuildup

makeassignmentset = GhPythonScript(
    AssignmentSetName="Option1",
    SingleLayerAssignments=[assignbuildup_7, assignbuildup_10, assignbuildup, assignbuildup_13, assignbuildup_3, assignbuildup_4, assignbuildup_5, assignbuildup_2, assignbuildup_9, assignbuildup_8, assignbuildup_6, assignbuildup_11, assignbuildup_14, assignbuildup_15, assignbuildup_12])  # -> out, LayerAssignmentSet; inputs SingleLayerAssignments: list
# ---------- makeassignmentset: Python ----------
from pprint import pprint
from collections import Counter
import Grasshopper as gh

# Initialize warning handler
warning = gh.Kernel.GH_RuntimeMessageLevel.Warning
error = gh.Kernel.GH_RuntimeMessageLevel.Error
remark = gh.Kernel.GH_RuntimeMessageLevel.Remark

listOfRhinoLayersWithAssignments = []
for dictionary in SingleLayerAssignments:
    for k,v in dictionary.items():
        listOfRhinoLayersWithAssignments.append(k)

print listOfRhinoLayersWithAssignments
for k,v in Counter(listOfRhinoLayersWithAssignments).items():
    if v > 1:
        duplicateRhinoLayer = k
        message = 'You have assigned more than one buildup to the same Rhino Layer, this is not allowed! ...yet ;). Rhino layer named: ' + str(duplicateRhinoLayer) + ' is duplicated.'
        ghenv.Component.AddRuntimeMessage(error, message)

collectedAssignments = {}
for dictionary in SingleLayerAssignments:
    for k,v in dictionary.items():
        collectedAssignments[k] = v

templateDict = [{AssignmentSetName: {
    "RhinoLayerAssignments": collectedAssignments, 
    "LayerAssignmentExcelInfo": {"ExcelPath" : 'Layer assignment performed in Grasshopper'}
    }}]
# pprint(templateDict)

LayerAssignmentSet = templateDict
# ---------- end makeassignmentset ----------

layerassignmentsets = Data(makeassignmentset.LayerAssignmentSet)
layerassignmentsets_2 = Data(layerassignmentsets)
insertstage3buildupsintodesignoptions = ApplyBuildupsToDesignOptions(
    Code=file_2,
    DesignOptionName=concat,
    ChildLayerMeasurements=importmeasurementsfromrhino.ChildLayerMeasurements,
    SelectedAssignmentSet=selectedassignmentoption,
    LayerAssignmentSets=layerassignmentsets_2,
    BuildupCatalogueStage3=buildupcataloguestage3_3,
    IncludeUpstreamErrors=includeupstreamerrors,
    CommentErrorsInExcel=commenterrorsinexcel5,
    ExcelErrorSeverityFilter=value_list,
    Run=Toggle(True))  # -> Out, LCAProjectDictionary, AssembliesMissingFromCatalogue, RhinoLayersMissingAssemblies, ErrorLog, ErrorsRelatedToGeometry
panel_4 = Panel(insertstage3buildupsintodesignoptions.Out)
lcaprojectdictionary = Data(insertstage3buildupsintodesignoptions.LCAProjectDictionary)
calculatelcascore = CalculateLCAScore(
    Code=file_3,
    BuildupsOrEntireProjects=calculation_mode,
    LCAProjectDictionary=lcaprojectdictionary,
    DesignOptionName=designoptionname_2,
    LCAAnalysisPeriod=Slider(50, range=0..200),
    MaterialReplacementRule=list,
    IndicatorsToCalculate="GWPtotal",
    CalculateBuildupLCAScore=calculatebuilduplcascore)  # -> Out, CalculationSummary, ProjectCalculationRoster, BuildupCalculationRostersDict, CalculationErrorRoster
lcabygfilter = GhPythonScript(CalculationRoster=calculatelcascore.ProjectCalculationRoster)  # -> CalculationsIncludedInLCABYG, CalculationsExcludedFromLCAByg, CalculationsOfDModule; inputs CalculationRoster: list
# ---------- lcabygfilter: Python ----------
LCABygLCAModules = ['A1-A3', 'C3', 'C4']

includedCalcs = []
excludedCalcs = []
dCalcs = []

for calcDict in CalculationRoster:
    if calcDict.get('LCAModule') in LCABygLCAModules:
        includedCalcs.append(calcDict)
    elif calcDict.get('LCAModule') == 'D':
        dCalcs.append(calcDict)
    else:
        excludedCalcs.append(calcDict)

CalculationsIncludedInLCABYG = includedCalcs
CalculationsExcludedFromLCAByg = excludedCalcs
CalculationsOfDModule = dCalcs
# ---------- end lcabygfilter ----------
calculationroster = Data(calculatelcascore.ProjectCalculationRoster)
calculationroster_2 = Data(calculationroster)
categorizecalcroster = CategorizeCalculationRoster(Code=file_4, CalculationRoster=calculationroster_2, CategorizeBy=graphtype)  # -> Out, Categories, GWPtotal, GWP_Dictionary
ppd = GhPythonScript(PythonDictionary=categorizecalcroster.GWP_Dictionary)  # -> simplify(out)
# ---------- ppd: Python ----------
from pprint import pprint

pprint(PythonDictionary)
# ---------- end ppd ----------
panel_5 = Panel(categorizecalcroster.GWP_Dictionary)
prettyprintclacroster = GhPythonScript(x=categorizecalcroster.GWP_Dictionary)  # -> simplify(out)
# ---------- prettyprintclacroster: Python ----------
from pprint import pprint

pprint(x)
# ---------- end prettyprintclacroster ----------
panel_6 = Panel(prettyprintclacroster)
drawheadsupdisplay = DrawHeadsUpDisplay(
    GWP_Dictionary=categorizecalcroster.GWP_Dictionary,
    ProjectFloorArea=projectfloorarea,
    Height=heightinpixels,
    Width=widthinpixels,
    LegendMax=digit_scroller_2,
    LegendMin=digit_scroller_3,
    TextHeight=textheight,
    Font=font)  # inputs Height: Int32, Width: Int32, Origin: Point3d
# ---------- drawheadsupdisplay: Python ----------
"""
Draw a heads up display (HUD) in screen space (i.e. on top of active 3D viewport).
This includes a combined program legend and total per program GFA bar chart,as well
as the total global GFA.
    Inputs:
        GWP_Dictionary: Database of categorized GWP data {item,dict}
        ViewportName: Optional input with a Viewport name in which the Heads Up 
            Display should be shown. {item, string}
        Height: Optional height of entire Heads Up Display in pixels, default is 1200. {item,int}
        Width: Optional width of entire Heads Up Display in pixels, default is 800. {item,int}
        Origin: Optional XY coordinates of the top left Heads Up Display corner. 
            Enter a point in model space that is in the positive X and negative
            Y quadrant. {item,point3d}
        Space: Space between bars in pixels {item,float}
        Font: Name of font to use {item,str}
    Outputs:
    Remarks:
        Author: Anders Holden Deleuran (BIG IDEAS)
        Contributor: Karim Daw (BIGS)
        Rhino: 7.13.21327.13001
        Version: 220119
"""

ghenv.Component.Name = "DrawHeadsUpDisplay"
ghenv.Component.NickName = "DrawHeadsUpDisplay"

import Rhino as rc
import System.Drawing as sd
from ghpythonlib.componentbase import executingcomponent as component
from pprint import pprint

# import rhino app for debugging
from Rhino import RhinoApp as ra
import Grasshopper as gh



def getRhinoUIColors():
    
    """ Get Rhino UI colors under Options > Appearance > Colors > General """
    
    # Define UI elements
    elements = (rc.ApplicationSettings.PaintColor.NormalStart,
    rc.ApplicationSettings.PaintColor.NormalEnd,
    rc.ApplicationSettings.PaintColor.HotStart,
    rc.ApplicationSettings.PaintColor.NormalBorder,
    rc.ApplicationSettings.PaintColor.TextEnabled,
    rc.ApplicationSettings.PaintColor.ActiveViewportTitle,
    rc.ApplicationSettings.PaintColor.InactiveViewportTitle)
    
    # Get their colors
    colors = [rc.ApplicationSettings.AppearanceSettings.GetPaintColor(v) for v in elements]
    
    return colors

defaultColour = sd.Color.DarkGray

log = []

class MyComponent(component):
    
    def RunScript(self, GWP_Dictionary, ProjectFloorArea,TargetPerArea, ViewportName, Height, Width, LegendMax, LegendMin, Origin, TextHeight,Font):
        
        # Initialize warning handler
        warning = gh.Kernel.GH_RuntimeMessageLevel.Warning
        error = gh.Kernel.GH_RuntimeMessageLevel.Error
        remark = gh.Kernel.GH_RuntimeMessageLevel.Remark
        inputErrorListForDisplay = []
        
        if not GWP_Dictionary:
            message = 'Please enter a valid GWP_Dictionary. '
            ghenv.Component.AddRuntimeMessage(warning, message)
            highestValue = 0
            lowestValue = 0
        if GWP_Dictionary:
            highestValue = max(GWP_Dictionary.get('Values'))
            lowestValue = min(GWP_Dictionary.get('Values'))
        self.uiColors = getRhinoUIColors()
        
        if not ProjectFloorArea:
            message = 'Please enter a ProjectFloorArea. '
            ghenv.Component.AddRuntimeMessage(warning, message)
        if ProjectFloorArea <= 0:
            message = 'ProjectFloorArea cannot be negative, it has been overridden as 1'
            ProjectFloorArea = 1
            ghenv.Component.AddRuntimeMessage(warning, message)
        
        if not TargetPerArea:
            TargetPerArea = 12
            message = 'TargetPerArea has been automatically set to 12 kg CO2 per m2 per year, which matches Danish 2023 regulations'
            ghenv.Component.AddRuntimeMessage(remark, message)
        if TargetPerArea <= 0:
            message = 'TargetPerArea cannot be negative, it has been overridden as 1'
            TargetPerArea = 1
            ghenv.Component.AddRuntimeMessage(warning, message)
            
        # Check GH Canvas inputs
        if ViewportName:
            message = 'Selecting a ViewportName is not yet possible. This feature will be implemented in the future. '
            ghenv.Component.AddRuntimeMessage(remark, message)
        if not Height:
            Height = 1200
        if not Width:
            Width = 800
        # Case 1 - Missing legend maximum
        if not LegendMax:
            if highestValue > 0:
                LegendMax = highestValue
            if highestValue <= 0:
                LegendMax = 0
        # Case 2 - Legend Maximum is not missing 
        if LegendMax:
            if LegendMax < 0:
                message = 'LegendMax must be greater than or equal to 0'
                ghenv.Component.AddRuntimeMessage(warning, message)
                LegendMax = 0
            if LegendMax < highestValue:
                LegendMax = highestValue
                message = 'LegendMax is too small and has been overwritten with the maximum input value. You must update LegendMax to be larger than ' + str(highestValue) + ' in order to display a consistent legend scale.'
                ghenv.Component.AddRuntimeMessage(warning, message)
                inputErrorListForDisplay.append(message)
        # Case 1 - Missing legend miniumum
        if not LegendMin:
            if lowestValue > 0:
                LegendMin = 0
            if lowestValue <= 0:
                LegendMin = lowestValue
        # Case 2 - Legend minimum is not missing
        if LegendMin:
            # Case 2A - Legend min is more than zero
            if LegendMin > 0:
                LegendMin = 0
                message = 'LegendMin must be less than or equal to 0'
                ghenv.Component.AddRuntimeMessage(warning, message)
                LegendMin = 0
            # Case 2B - Legend min is zero
            if LegendMin == 0:
                if lowestValue < 0:
                    LegendMin = lowestValue
                    message = 'LegendMin is too large and has been overwritten with the lowest input value. You must update LegendMax to be smaller than ' + str(lowestValue) + ' in order to display a consistent legend scale.'
                    ghenv.Component.AddRuntimeMessage(warning, message)
                    inputErrorListForDisplay.append(message)
            # Case 2C - Legend min is less than or equal to Zero
            if LegendMin < 0:
                if LegendMin > lowestValue:
                    LegendMin = lowestValue
                    message = 'LegendMin is too large and has been overwritten with the lowest input value. Update LegendMin to be smaller than ' + str(lowestValue) + '.'
                    ghenv.Component.AddRuntimeMessage(warning, message)
                    inputErrorListForDisplay.append(message)
                if lowestValue >= 0:
                    LegendMin = 0
                    message = 'LegendMin has been changed to 0 for this visualization because there are no negative values.'
                    ghenv.Component.AddRuntimeMessage(remark, message)
                    inputErrorListForDisplay.append(message)
            if not TextHeight:
                TextHeight = 20
            if not TargetPerArea:
                TargetPerArea = 12

        if not Origin:
            Origin = rc.Geometry.Point3d(0,0,0)

        print inputErrorListForDisplay
        # Check and assign inputs
        if GWP_Dictionary:
            self.errors = GWP_Dictionary.get('ErrorList') + inputErrorListForDisplay
            self.categorizeBy = GWP_Dictionary.get('CategorizeBy')
            self.projectFloorArea = ProjectFloorArea
            self.graphMode = GWP_Dictionary.get('GraphMode')
            self.pt = Origin
            #print(self.pt)
            self.categories = GWP_Dictionary["Categories"]
            self.values = GWP_Dictionary["Values"]
            self.lcaAnalysisPeriod = GWP_Dictionary["LCAAnalysisPeriod"]
            self.height = Height
            self.width = Width
            self.legendMax = LegendMax
            if LegendMin > 0:
                self.legendMin = 0
            if LegendMin <= 0:
                self.legendMin = LegendMin
            self.textHeight = TextHeight
            self.font = Font
            self.dark = sd.Color.FromArgb(255,36,36,36)
            self.LCAIconDict = {}
            self.LCAColors = {}
            self.targetPerArea = TargetPerArea
            self.render = True
        else:
            self.render = False
        
    def DrawForeground(self,sender,arg):
        
        # Drawing/edit states
        if self.drawingWires and self.render:
            if arg.Viewport.Id == arg.RhinoDoc.ActiveDoc.Views.ActiveView.ActiveViewportID:
                self.drawingWires = False
                
                # ALL COLORS -------------------------------------------------------------------------------------------------------------------- 
                colorBlack = sd.Color.FromArgb(255, 0, 0, 0)
                colorLightGrey = sd.Color.FromArgb(255, 180, 180, 180)
                
                # BACKGROUND ---------------------------------------------------------------------------------------------------------------------
                # Define key dimensions
                margin = 20
                # Get the size of the active viewport
                viewportWidth = rc.RhinoDoc.ActiveDoc.Views.ActiveView.Size.Width
                viewportHeight = rc.RhinoDoc.ActiveDoc.Views.ActiveView.Size.Height
                # Set max values for size of the heads up display
                backgroundMaxHeight = viewportHeight - 2*margin
                backgroundMaxWidth = viewportWidth - 2*margin
                  # Define the size of the heads up display
                if self.width > backgroundMaxWidth:
                    backgroundWidth = backgroundMaxWidth
                else:
                    backgroundWidth = self.width
                if self.height > backgroundMaxHeight:
                    backgroundHeight = backgroundMaxHeight
                else:
                    backgroundHeight = self.height
                
                # Define the location of the heads up display
                if self.pt:
                    backgroundXpos = self.pt.X + margin
                    backgroundYpos = -self.pt.Y + margin*2
                if not self.pt:
                    backgroundXpos = margin
                    backgroundYpos = margin
                
                # Draw the bakcground rectangle and assign its color
                backRect = sd.Rectangle(backgroundXpos,backgroundYpos, backgroundWidth, backgroundHeight)
                backRectCol =  sd.Color.FromArgb(40, self.uiColors[3].R,self.uiColors[3].G,self.uiColors[3].B)
                #arg.Display.Draw2dRectangle(backRect,self.uiColors[3],1,backRectCol)
                
                # DISPLAY AREA -------------------------------------------------------------------------------------------------------------------
                # Define ratio of graphingArea vs conclusionsArea (i.e. 3 means 
                # the graphing area is 3 times taller than the conclusions area)
                graphAreaHeightRatio = 3
                displayXPos = backgroundXpos + margin
                displayYPos = backgroundYpos + margin
                displayWidth = backgroundWidth - 2*margin
                displayHeight = backgroundHeight - 2*margin
                
                # Draw the display area for graphics
                displayAreaRectangle = sd.Rectangle(displayXPos,displayYPos,displayWidth,displayHeight)
                displayAreaLineColor = sd.Color.FromArgb(255/2, 50, 50, 50)
                displayAreaLineThickness = 1
                displayAreaFillColor = sd.Color.FromArgb(0, 55, 154, 70)
                # arg.Display.Draw2dRectangle(displayAreaRectangle,displayAreaLineColor,displayAreaLineThickness,displayAreaFillColor)
                
                # Define the ratio between the graphing area and the conclusions area
                # (i.e. 3 means the graphing area is 3 times higher than conclusions area.
                graphingVsConclusionsHeightRatio = 3
                
                # Define margins between these areas
                oneGraphingHeightModule = (displayHeight - margin)/(graphingVsConclusionsHeightRatio + 1)
                
                # TITLE AREA (TOP) --------------------------------------------------------------------------------------------------------------
                titleAreaXPos = displayXPos
                titleAreaYPos = displayYPos
                titleAreaWidth = displayWidth
                titleAreaHeight = oneGraphingHeightModule/4
                titleAreaRectangle = sd.Rectangle(titleAreaXPos,titleAreaYPos,titleAreaWidth,titleAreaHeight)
                # Draw the display area for graphics
                titleAreaRectangle = sd.Rectangle(titleAreaXPos,titleAreaYPos,titleAreaWidth,titleAreaHeight)
                titleAreaLineColor = sd.Color.FromArgb(255/2, 50, 50, 50)
                titleAreaLineThickness = 1
                titleAreaFillColor = sd.Color.FromArgb(0, 55, 154, 70)
                # COMMENT NEXT LINE TO TURN BOX OFF
                #arg.Display.Draw2dRectangle(titleAreaRectangle,titleAreaLineColor,titleAreaLineThickness,titleAreaFillColor)
                
                # DRAW BIG SUSTAINABILITY ICON ------------------------------------------------------------------------------------------------
                
                self.getBIGSLogoIcon()
                
                BIGSLogoiconPath = self.getBIGSLogoIconDict.get("BIGSLogo")
                BIGSLogoBitMap = rc.Display.DisplayBitmap.Load(BIGSLogoiconPath)
                BIGSLogoScale = titleAreaHeight/4
                BIGSLogoWidth = 18.9*BIGSLogoScale
                BIGSLogoHeight = 2.3*BIGSLogoScale
                
                BIGSLogoYPos = titleAreaYPos + BIGSLogoHeight/2
                BIGSLogoXPos = titleAreaXPos + BIGSLogoWidth/2
                BIGSLogoPoint = rc.Geometry.Point2d(BIGSLogoXPos,BIGSLogoYPos)
                arg.Display.DrawSprite(BIGSLogoBitMap,BIGSLogoPoint,BIGSLogoWidth,BIGSLogoHeight)
                
                # DRAW TITLE ------------------------------------------------------------------------------------------------------------------
                # Draw Graph Title
                titleTextHeight = self.textHeight*1.5
                titleTextString = 'Tons CO2 eq grouped by ' + str(self.categorizeBy)
                titleTextColor = colorBlack
                titleTextPointXPos = titleAreaXPos
                titleTextPointYPos = titleAreaYPos + BIGSLogoHeight + margin/2
                titleTextPoint = rc.Geometry.Point2d(titleTextPointXPos,titleTextPointYPos)
                titleTextMiddleJustified = False
                titleTextFont = self.font
                arg.Display.Draw2dText(titleTextString,titleTextColor,titleTextPoint,titleTextMiddleJustified,titleTextHeight,titleTextFont)
                
                # GRAPH AREA (MIDDLE) -------------------------------------------------------------------------------------------------------------
                # Define the graphing area
                graphingAreaXPos = displayXPos
                graphingAreaYPos = displayYPos + titleAreaHeight + margin
                graphingAreaWidth = displayWidth
                graphingAreaHeight = oneGraphingHeightModule*graphingVsConclusionsHeightRatio - (titleAreaHeight +  margin)
                # Draw the display area for graphics
                graphingAreaRectangle = sd.Rectangle(graphingAreaXPos,graphingAreaYPos,graphingAreaWidth,graphingAreaHeight)
                graphingAreaLineColor = sd.Color.FromArgb(255/2, 50, 50, 50)
                graphingAreaLineThickness = 1
                graphingAreaFillColor = sd.Color.FromArgb(0, 55, 154, 70)
                # COMMENT NEXT LINE TO TURN BOX OFF
                # arg.Display.Draw2dRectangle(graphingAreaRectangle,graphingAreaLineColor,graphingAreaLineThickness,graphingAreaFillColor)
                
                # CONCLUSIONS AREA (BOTTOM) -------------------------------------------------------------------------------------------------------
                # Define the conclusions area
                conclusionsAreaXPos = displayXPos
                conclusionsAreaYPos = graphingAreaYPos + graphingAreaHeight + margin
                conclusionsAreaWidth = displayWidth
                conclusionsAreaHeight = oneGraphingHeightModule
                # Draw the display area for conclusions
                conclusionsAreaRectangle = sd.Rectangle(conclusionsAreaXPos,conclusionsAreaYPos,conclusionsAreaWidth,conclusionsAreaHeight)
                conclusionsAreaLineColor = sd.Color.FromArgb(255/2, 50, 50, 50)
                conclusionsAreaLineThickness = 1
                conclusionsAreaFillColor = sd.Color.FromArgb(0, 55, 154, 70)
                # COMMENT NEXT LINE TO TURN BOX OFF
                #arg.Display.Draw2dRectangle(conclusionsAreaRectangle,conclusionsAreaLineColor,conclusionsAreaLineThickness,conclusionsAreaFillColor)
                
                # DATA BARS IN GRAPHING AREA -----------------------------------------------------------------------------------------------------
                # Define key height dimensions
                gapBetweenDataBars = 8
                numberOfBars = len(self.categories)
                totalWhiteSpaceHeight = (numberOfBars)*gapBetweenDataBars
                dataBarHeight = (graphingAreaHeight-totalWhiteSpaceHeight)/numberOfBars
                iconSize = dataBarHeight * 1.3
                # Define key width dimensions
                rightHandtextAndIconBuffer = 100
                leftHandtextAndIconBuffer = iconSize
                if self.legendMax >= 0 and self.legendMin >= 0:
                    totalGraphLegendWidth =  self.legendMax - self.legendMin
                if self.legendMax >= 0 and self.legendMin < 0:
                    totalGraphLegendWidth =  self.legendMax + abs(self.legendMin)
                if self.legendMax < 0 and self.legendMin >= 0:
                    # This should never happen, the legend max must be greater than legend min
                    pass
                if self.legendMax < 1 and self.legendMin < 1:
                    totalGraphLegendWidth =  abs(self.legendMax) - abs(self.legendMin)
                xAxisWidth = graphingAreaWidth - rightHandtextAndIconBuffer - leftHandtextAndIconBuffer
                xAxisXPos = graphingAreaXPos
                pixelsPerInputUnit = xAxisWidth / totalGraphLegendWidth
                if self.legendMin >= 0:
                    yAxisXPos = graphingAreaXPos + leftHandtextAndIconBuffer
                if self.legendMin < 0:
                    yAxisXPos = graphingAreaXPos + leftHandtextAndIconBuffer + (abs(self.legendMin)*pixelsPerInputUnit)

                # Iterate over each category and draw a databar
                dataBarYPos = graphingAreaYPos

                # GWP GRAPH -------------------------------------------------------------------------------------------------------------------------
                if self.graphMode == 'LCAModule':
                    dataBarYPos += gapBetweenDataBars/2
                    # Get LCA colors and assign them
                    self.getLCAColors()
                    
                    # LCA DATA BARS ------------------------------------------------------------------------------------------------------------------
                    # dataBarYPos += gapBetweenDataBars + dataBarHeight
                    totalValue = sum(self.values)
                    for categ, value in zip(self.categories, self.values):
                        # Define the dataBars
                        dataBarWidth = pixelsPerInputUnit * abs(value)
                        if value >= 0:
                            dataBarXPos = yAxisXPos
                        elif value < 0:
                            dataBarXPos = yAxisXPos - dataBarWidth
                        # Draw the display area for conclusions
                        dataBarRectangle = sd.Rectangle(dataBarXPos,dataBarYPos,dataBarWidth,dataBarHeight)
                        dataBarLineColor = sd.Color.FromArgb(255/2, 50, 50, 50)
                        dataBarLineThickness = 0
                        if categ in self.LCAColors.keys():
                            dataBarFillColor = self.LCAColors[categ]
                        else:
                            dataBarFillColor = defaultColour
                        arg.Display.Draw2dRectangle(dataBarRectangle,dataBarLineColor,dataBarLineThickness,dataBarFillColor)
                        
                        # LCA ICONS ------------------------------------------------------------------------------------------------------------------
                        self.getLCAIcons()
                        if categ in self.LCAIconDict.keys():
                            iconPath = self.LCAIconDict[categ]
                            # draw sprites
                            endOfBarMidpointXPos = dataBarXPos + dataBarWidth
                            endOfBarMidpointYPos = dataBarYPos + dataBarHeight/2
                            
                            spriteHeight = iconSize
                            spriteWidth = iconSize
                            if value >= 0:
                                spriteXPos = yAxisXPos - spriteWidth - gapBetweenDataBars + (spriteWidth/2)
                            elif value < 0:
                                spriteXPos = yAxisXPos - dataBarWidth - spriteWidth - gapBetweenDataBars + (spriteWidth/2)
                            
                            spriteYPos = endOfBarMidpointYPos
                            spritePoint = rc.Geometry.Point2d(spriteXPos,spriteYPos)
                            bitMap = rc.Display.DisplayBitmap.Load(iconPath)
                            arg.Display.DrawSprite(bitMap,spritePoint,spriteHeight,spriteWidth)
                            
                            # CATEGORY LABELS --------------------------------------------------------------------------------------------------------
                            # Draw program text
                            categoryLabelHeight = self.textHeight
                            categoryLabelString = categ
                            
                            # Option 1
                            #categoryLabelColor = self.LCAColors[categ]
                            #categoryLabelPointXPos = endOfBarMidpointXPos + gapBetweenDataBars
                            #categoryLabelPointYPos = dataBarYPos + 0.25*(dataBarHeight)
                            # Option 2
                            categoryLabelColor = colorBlack
                            categoryLabelPointXPos = endOfBarMidpointXPos + gapBetweenDataBars
                            categoryLabelPointYPos = dataBarYPos
                            
                            categoryLabelPoint = rc.Geometry.Point2d(categoryLabelPointXPos,categoryLabelPointYPos)
                            categoryLabelMiddleJustified = False
                            categoryLabelFont = self.font
                            arg.Display.Draw2dText(categoryLabelString,categoryLabelColor,categoryLabelPoint,categoryLabelMiddleJustified,categoryLabelHeight,categoryLabelFont)
                            categoryLabelRectangle = arg.Display.Measure2dText(categoryLabelString,categoryLabelPoint,categoryLabelMiddleJustified,0,categoryLabelHeight,categoryLabelFont)
                            categoryLabelWidth = categoryLabelRectangle.Width
                            
                            # DATA VALUE LABELS  -----------------------------------------------------------------------------------------------------
                            dataTextHeight = self.textHeight
                            dataTextValue = value*.001
                            dataTextString = str("{0:,.0f}".format(dataTextValue))
                            dataTextColor = colorLightGrey
                            
                            # Option 1
                            #dataTextPointXPos = endOfBarMidpointXPos + gapBetweenDataBars + categoryLabelWidth + gapBetweenDataBars*3
                            #dataTextPointYPos = dataBarYPos + 0.25*(dataBarHeight)
                            # Option 2
                            dataTextPointXPos = endOfBarMidpointXPos + gapBetweenDataBars
                            dataTextPointYPos = dataBarYPos + dataBarHeight/2
    
                            dataTextPoint = rc.Geometry.Point2d(dataTextPointXPos,dataTextPointYPos)
                            dataTextMiddleJustified = False
                            dataTextFont = self.font
                            arg.Display.Draw2dText(dataTextString,dataTextColor,dataTextPoint,dataTextMiddleJustified,dataTextHeight,dataTextFont)
                            dataTextRectangle = arg.Display.Measure2dText(dataTextString,dataTextPoint,dataTextMiddleJustified,0,dataTextHeight,dataTextFont)
                            dataTextWidth = dataTextRectangle.Width
                            
                            # PERCENTAGE LABELS  -----------------------------------------------------------------------------------------------------
                            percentTextHeight = self.textHeight
                            percentTextValue = value/totalValue
                            percentTextString = '(' + str("{0:,.0f}".format(100*percentTextValue)) + '%' + ')'
                            percentTextColor = colorLightGrey
                            
                            # Option 1
                            # percentTextPointXPos = endOfBarMidpointXPos + gapBetweenDataBars*3 + categoryLabelWidth + gapBetweenDataBars
                            # percentTextPointYPos = dataBarYPos
                            # Option 2
                            percentTextPointXPos = endOfBarMidpointXPos + gapBetweenDataBars + dataTextWidth + gapBetweenDataBars
                            percentTextPointYPos = dataBarYPos + dataBarHeight/2
    
                            percentTextPoint = rc.Geometry.Point2d(percentTextPointXPos,percentTextPointYPos)
                            percentTextMiddleJustified = False
                            percentTextFont = self.font
                            arg.Display.Draw2dText(percentTextString,percentTextColor,percentTextPoint,percentTextMiddleJustified,percentTextHeight,percentTextFont)
                            percentTextRectangle = arg.Display.Measure2dText(percentTextString,percentTextPoint,percentTextMiddleJustified,0,percentTextHeight,percentTextFont)
                            percentTextWidth = percentTextRectangle.Width
                            
                        # Incease y position for next loop
                        dataBarYPos += gapBetweenDataBars + dataBarHeight
                        
                        
                    # DRAW Y AXIS  -----------------------------------------------------------------------------------------------------
                    yAxisColor = colorBlack
                    yAxisLineWeight = 1
                    yAxisTopPoint = sd.Point(yAxisXPos, graphingAreaYPos)
                    yAxisBottomPoint = sd.Point(yAxisXPos, graphingAreaYPos + graphingAreaHeight)
                    arg.Display.Draw2dLine(yAxisTopPoint,yAxisBottomPoint,yAxisColor,yAxisLineWeight)
                    
                    # DRAW X AXIS  -----------------------------------------------------------------------------------------------------
                    xAxisColor = colorBlack
                    xAxisLineWeight = 1
                    xAxisLeftPoint = sd.Point(xAxisXPos, graphingAreaYPos + graphingAreaHeight)
                    xAxisRightPoint = sd.Point(xAxisXPos + graphingAreaWidth, graphingAreaYPos + graphingAreaHeight)
                    # Turned off
                    # arg.Display.Draw2dLine(xAxisLeftPoint,xAxisRightPoint,xAxisColor,xAxisLineWeight)
                    
                # STANDARD GRAPH ---------------------------------------------------------------------------------------------------------------------
                elif self.graphMode == 'Standard':
                    # SET UP AXIS AND KEY DIMENSIONS  -----------------------------------------------------------------------------------------------------
                    # Define key height dimensions
                    gapBetweenDataBars = 8
                    numberOfBars = len(self.categories)
                    # totalWhiteSpaceHeight = (numberOfBars - 1)*gapBetweenDataBars
                    totalWhiteSpaceHeight = (numberOfBars)*gapBetweenDataBars  
                    dataBarHeight = (graphingAreaHeight-totalWhiteSpaceHeight)/numberOfBars
                    # iconSize = dataBarHeight * 1.3
                    # Define key width dimensions
                    rightHandtextAndIconBuffer = 100
                    leftHandtextAndIconBuffer = 0
                    if self.legendMax >= 0 and self.legendMin >= 0:
                        totalGraphLegendWidth =  self.legendMax - self.legendMin
                    if self.legendMax >= 0 and self.legendMin < 0:
                        totalGraphLegendWidth =  self.legendMax + abs(self.legendMin)
                    if self.legendMax < 0 and self.legendMin >= 0:
                        # This should never happen, the legend max must be greater than legend min
                        pass
                    if self.legendMax < 1 and self.legendMin < 1:
                        totalGraphLegendWidth =  abs(self.legendMax) - abs(self.legendMin)
                    xAxisWidth = graphingAreaWidth - rightHandtextAndIconBuffer - leftHandtextAndIconBuffer
                    xAxisXPos = graphingAreaXPos
                    pixelsPerInputUnit = xAxisWidth / totalGraphLegendWidth
                    if self.legendMin >= 0:
                        yAxisXPos = graphingAreaXPos + leftHandtextAndIconBuffer
                    if self.legendMin < 0:
                        yAxisXPos = graphingAreaXPos + leftHandtextAndIconBuffer + (abs(self.legendMin)*pixelsPerInputUnit)

                    # Get LCA colors and assign them
                    self.getLCAColors()
    
                    # Iterate over each category and draw a databar
                    dataBarYPos = graphingAreaYPos
                    dataBarYPos += gapBetweenDataBars/2
                    
                    # DATA BARS ----------------------------------------------------------------------------------------------------------------------
                    # Skip one data bar to leave space for title
                    # dataBarYPos += titleTextHeight + gapBetweenDataBars
                    totalValue = sum(self.values)
                    for categ, value in zip(self.categories, self.values):
                        # Define the dataBars
                        dataBarWidth = pixelsPerInputUnit * abs(value)
                        if value >= 0:
                            dataBarXPos = yAxisXPos
                        elif value < 0:
                            dataBarXPos = yAxisXPos - dataBarWidth
                        # Draw the display area for conclusions
                        dataBarRectangle = sd.Rectangle(dataBarXPos,dataBarYPos,dataBarWidth,dataBarHeight)
                        dataBarLineColor = sd.Color.FromArgb(255/2, 50, 50, 50)
                        dataBarLineThickness = 0
                        if categ in self.LCAColors.keys():
                            dataBarFillColor = self.LCAColors[categ]
                        else:
                            dataBarFillColor = defaultColour
                        arg.Display.Draw2dRectangle(dataBarRectangle,dataBarLineColor,dataBarLineThickness,dataBarFillColor)
                        
                        # LCA ICONS ------------------------------------------------------------------------------------------------------------------
                        self.getLCAIcons()
                        
                        if categ in self.LCAIconDict.keys():
                            iconPath = self.LCAIconDict[categ]
                            # draw sprites

                            spriteHeight = iconSize
                            spriteWidth = iconSize
                            if value >= 0:
                                spriteXPos = yAxisXPos - spriteWidth - gapBetweenDataBars + (spriteWidth/2)
                            elif value < 0:
                                spriteXPos = yAxisXPos - dataBarWidth - spriteWidth - gapBetweenDataBars + (spriteWidth/2)
                            
                            spriteYPos = endOfBarMidpointYPos
                            spritePoint = rc.Geometry.Point2d(spriteXPos,spriteYPos)
                            bitMap = rc.Display.DisplayBitmap.Load(iconPath)
                            arg.Display.DrawSprite(bitMap,spritePoint,spriteHeight,spriteWidth)
                            
                        # CATEGORY LABELS --------------------------------------------------------------------------------------------------------
                        endOfBarMidpointXPos = dataBarXPos + dataBarWidth
                        endOfBarMidpointYPos = dataBarYPos + dataBarHeight/2
                        # Draw program text
                        categoryLabelHeight = self.textHeight
                        categoryLabelString = str(categ)
                        # Option 1
                        #categoryLabelColor = self.LCAColors[categ]
                        #categoryLabelPointXPos = endOfBarMidpointXPos + gapBetweenDataBars
                        #categoryLabelPointYPos = dataBarYPos + 0.25*(dataBarHeight)
                        # Option 2
                        categoryLabelColor = colorBlack
                        categoryLabelPointXPos = endOfBarMidpointXPos + gapBetweenDataBars
                        #categoryLabelPointYPos = dataBarYPos + dataBarHeight/2 - categoryLabelHeight
                        categoryLabelPointYPos = dataBarYPos
                        
                        categoryLabelPoint = rc.Geometry.Point2d(categoryLabelPointXPos,categoryLabelPointYPos)
                        categoryLabelMiddleJustified = False
                        categoryLabelFont = self.font
                        arg.Display.Draw2dText(categoryLabelString,categoryLabelColor,categoryLabelPoint,categoryLabelMiddleJustified,categoryLabelHeight,categoryLabelFont)
                        categoryLabelRectangle = arg.Display.Measure2dText(categoryLabelString,categoryLabelPoint,categoryLabelMiddleJustified,0,categoryLabelHeight,categoryLabelFont)
                        categoryLabelWidth = categoryLabelRectangle.Width
                        categoryLabelHeight = categoryLabelRectangle.Height
                        
                        # DATA VALUE LABELS  -----------------------------------------------------------------------------------------------------
                        dataTextHeight = self.textHeight
                        dataTextValue = value*.001
                        dataTextString = str("{0:,.0f}".format(dataTextValue))
                        dataTextColor = colorLightGrey
                        
                        # Option 1
                        #dataTextPointXPos = endOfBarMidpointXPos + gapBetweenDataBars + categoryLabelWidth + gapBetweenDataBars*3
                        #dataTextPointYPos = dataBarYPos + 0.25*(dataBarHeight)
                        # Option 2
                        dataTextPointXPos = endOfBarMidpointXPos + gapBetweenDataBars
                        dataTextPointYPos = dataBarYPos + dataBarHeight/2

                        dataTextPoint = rc.Geometry.Point2d(dataTextPointXPos,dataTextPointYPos)
                        dataTextMiddleJustified = False
                        dataTextFont = self.font
                        arg.Display.Draw2dText(dataTextString,dataTextColor,dataTextPoint,dataTextMiddleJustified,dataTextHeight,dataTextFont)
                        dataTextRectangle = arg.Display.Measure2dText(dataTextString,dataTextPoint,dataTextMiddleJustified,0,dataTextHeight,dataTextFont)
                        dataTextWidth = dataTextRectangle.Width
                        
                        # PERCENTAGE LABELS  -----------------------------------------------------------------------------------------------------
                        percentTextHeight = self.textHeight
                        percentTextValue = value/totalValue
                        percentTextString = '(' + str("{0:,.0f}".format(100*percentTextValue)) + '%' + ')'
                        percentTextColor = colorLightGrey
                        
                        # Option 1
                        # percentTextPointXPos = endOfBarMidpointXPos + gapBetweenDataBars*3 + categoryLabelWidth + gapBetweenDataBars
                        # percentTextPointYPos = dataBarYPos
                        # Option 2
                        percentTextPointXPos = endOfBarMidpointXPos + gapBetweenDataBars + dataTextWidth + gapBetweenDataBars
                        percentTextPointYPos = dataBarYPos + dataBarHeight/2

                        percentTextPoint = rc.Geometry.Point2d(percentTextPointXPos,percentTextPointYPos)
                        percentTextMiddleJustified = False
                        percentTextFont = self.font
                        arg.Display.Draw2dText(percentTextString,percentTextColor,percentTextPoint,percentTextMiddleJustified,percentTextHeight,percentTextFont)
                        percentTextRectangle = arg.Display.Measure2dText(percentTextString,percentTextPoint,percentTextMiddleJustified,0,percentTextHeight,percentTextFont)
                        percentTextWidth = percentTextRectangle.Width
                            
                        # Incease y position for next loop
                        dataBarYPos += gapBetweenDataBars + dataBarHeight
                        
                        

                    # DRAW Y AXIS  -----------------------------------------------------------------------------------------------------
                    yAxisColor = colorBlack
                    yAxisLineWeight = 1
                    yAxisTopPoint = sd.Point(yAxisXPos, graphingAreaYPos)
                    yAxisBottomPoint = sd.Point(yAxisXPos, graphingAreaYPos + graphingAreaHeight)
                    arg.Display.Draw2dLine(yAxisTopPoint,yAxisBottomPoint,yAxisColor,yAxisLineWeight)
                    
                    # DRAW X AXIS  -----------------------------------------------------------------------------------------------------
                    xAxisColor = colorBlack
                    xAxisLineWeight = 1
                    xAxisLeftPoint = sd.Point(xAxisXPos, graphingAreaYPos + graphingAreaHeight)
                    xAxisRightPoint = sd.Point(xAxisXPos + graphingAreaWidth, graphingAreaYPos + graphingAreaHeight)
                    # Turned off
                    # arg.Display.Draw2dLine(xAxisLeftPoint,xAxisRightPoint,xAxisColor,xAxisLineWeight)
  
                # DRAW TOTAL GFA  --------------------------------------------------------------------------------------------------
                # Note: This might seem out of place in terms of the sequence that it graphically appears, but the values determined
                # here define the Target bar graph. So the cod has to appear first. Pay attention to variables containing YPos and Height
                GWPPerGFAHeight = 2 * (conclusionsAreaHeight / 7)
                # Print total GFA
                totalValue = int(round(totalValue*0.001,0))
                totalValueString = "{0:,}".format(totalValue)
                GWPPerGFAPerYear = 1000*totalValue / (self.projectFloorArea*self.lcaAnalysisPeriod)
                GWPPerGFAPerYearSTring = "{0:0.1f}".format(GWPPerGFAPerYear)
                totalGWPperGFAText = "Total Global Warming Potential: {0} Tons C02 eq".format(totalValueString)
                totalGWPperGFAText += "\nLife Cycle Analysis Period: {0} years".format(int(round(self.lcaAnalysisPeriod)))
                totalGWPperGFAColor = self.dark
                totalGWPperGFAYPos = conclusionsAreaYPos + GWPPerGFAHeight + 1.5*margin
                totalGWPperGFAPoint = rc.Geometry.Point2d(conclusionsAreaXPos,totalGWPperGFAYPos)
                totalGWPperGFAMiddleJustification = False
                totalGWPperGFAHeight = self.textHeight*1.2
                totalGWPperGFAFont = self.font
                arg.Display.Draw2dText(totalGWPperGFAText,totalGWPperGFAColor,totalGWPperGFAPoint,totalGWPperGFAMiddleJustification,totalGWPperGFAHeight,totalGWPperGFAFont)
                totalGWPperGFARectangle = arg.Display.Measure2dText(totalGWPperGFAText,totalGWPperGFAPoint,totalGWPperGFAMiddleJustification,0,totalGWPperGFAHeight,totalGWPperGFAFont)
                totalGWPperGFAHeight = totalGWPperGFARectangle.Height
                
                # DRAW TARGET BAR GRAPH ----------------------------------------------------------------------------------------------
                green = sd.Color.FromArgb(255, 0, 200, 0)
                red = sd.Color.FromArgb(255, 200, 0, 0)
                # Note that this code is the same regardless of the graphing mode
                
                # Define key dimensions
                if GWPPerGFAPerYear <= (self.targetPerArea*1.2):
                    targetGraphLegendScale = self.targetPerArea*1.2
                    targetBarFillColor = green
                if GWPPerGFAPerYear > (self.targetPerArea*1.2):
                    targetGraphLegendScale = GWPPerGFAPerYear
                    targetBarFillColor = red
                rightHandTargetGraphBuffer = 110
                targetBarGraphWidth = conclusionsAreaWidth - rightHandTargetGraphBuffer
                pixelsPerInputUnit = targetBarGraphWidth / targetGraphLegendScale
                
                # Define the score rectangle
                targetContainerHeight = conclusionsAreaHeight / 7
                targetContainerXPos = conclusionsAreaXPos
                targetContainerYPos = conclusionsAreaYPos + targetContainerHeight - 0.5* margin
                targetContainerWidth = conclusionsAreaWidth
                
                # Draw the score rectangle
                targetContainerRectangle = sd.Rectangle(targetContainerXPos,targetContainerYPos,targetContainerWidth,targetContainerHeight)
                
                targetContainerLineColor = sd.Color.FromArgb(100, 150, 150, 150)
                targetContainerFillColor = sd.Color.FromArgb(0, 255, 255, 255)
                targetContainerLineThickness = 1
                arg.Display.Draw2dRectangle(targetContainerRectangle,targetContainerLineColor,targetContainerLineThickness,targetContainerFillColor)
                # Define the score rectangle
                targetBarHeight = targetContainerHeight
                targetBarXPos = conclusionsAreaXPos
                targetBarYPos = targetContainerYPos
                targetBarWidth = pixelsPerInputUnit*GWPPerGFAPerYear
                # Draw the score rectangle
                targetBarRectangle = sd.Rectangle(targetBarXPos,targetBarYPos,targetBarWidth,targetBarHeight)
                targetBarLineColor = self.dark
                if GWPPerGFAPerYear <= (self.targetPerArea):
                    targetBarFillColor = green
                if GWPPerGFAPerYear > (self.targetPerArea):
                    targetBarFillColor = red
                targetBarLineThickness = 1
                arg.Display.Draw2dRectangle(targetBarRectangle,targetBarLineColor,targetBarLineThickness,targetBarFillColor)
                
                # DRAW TARGET TICK MARK ----------------------------------------------------------------------------------------------
                # Define and draw the target tick mark
                targetTickColor = colorBlack
                targetTickLineWeight = 3
                targetTickXPos = conclusionsAreaXPos + (pixelsPerInputUnit*self.targetPerArea)
                targetTickTopPoint = sd.Point(targetTickXPos, targetBarYPos )
                targetTickBottomPoint = sd.Point(targetTickXPos, targetBarYPos + targetBarHeight)
                arg.Display.Draw2dLine(targetTickTopPoint,targetTickBottomPoint,targetTickColor,targetTickLineWeight)
                
                # Define and draw targetTickText
                # Draw program text
                targetTickTextHeight = self.textHeight*.75
                targetTickTextString = "TARGET = {0} kg CO2 eq / m2 year".format(str(self.targetPerArea))
                targetTickTextColor = targetContainerLineColor
                targetTickTextPointXPos = targetTickXPos
                targetTickTextPointYPos = targetContainerYPos + targetBarHeight + gapBetweenDataBars
                targetTickTextPoint = rc.Geometry.Point2d(targetTickTextPointXPos,targetTickTextPointYPos)
                targetTickTextMiddleJustified = False
                targetTickTextFont = self.font
                arg.Display.Draw2dText(targetTickTextString,targetTickTextColor,targetTickTextPoint,targetTickTextMiddleJustified,targetTickTextHeight,targetTickTextFont)
                targetTickTextRectangle = arg.Display.Measure2dText(targetTickTextString,targetTickTextPoint,targetTickTextMiddleJustified,0,targetTickTextHeight,targetTickTextFont)
                targetTickTextWidth = targetTickTextRectangle.Width
                targetTickTextHeight = targetTickTextRectangle.Height
                
                # DRAW TARGET DATA LABEL ----------------------------------------------------------------------------------------------
                endOfTargetBarMidpointXPos = conclusionsAreaXPos + targetBarWidth
                endOfTargetBarMidpointYPos = targetBarYPos + (targetBarHeight/2)
                targetDataTextHeight = self.textHeight
                targetDataTextValue = GWPPerGFAPerYear
                targetDataTextString = str("{0:,.2f} ".format(targetDataTextValue))
                targetDataTextColor = colorLightGrey
                targetDataTextPointXPos = endOfTargetBarMidpointXPos + gapBetweenDataBars
                targetDataTextPointYPos = endOfTargetBarMidpointYPos - targetDataTextHeight/2

                targetDataTextPoint = rc.Geometry.Point2d(targetDataTextPointXPos,targetDataTextPointYPos)
                targetDataTextMiddleJustified = False
                targetDataTextFont = self.font
                arg.Display.Draw2dText(targetDataTextString,targetDataTextColor,targetDataTextPoint,targetDataTextMiddleJustified,targetDataTextHeight,targetDataTextFont)
                targetDataTextRectangle = arg.Display.Measure2dText(targetDataTextString,targetDataTextPoint,targetDataTextMiddleJustified,0,targetDataTextHeight,targetDataTextFont)
                targetDataTextWidth = targetDataTextRectangle.Width
                
                 # Print total GFA
                
                targetGraphLabelText = "Global Warming Potential per unit floor area".format(totalValueString)
                targetGraphLabelColor = self.dark
                targetGraphLabelMiddleJustification = False
                targetGraphLabelHeight = self.textHeight*1.2
                targetGraphLabelPoint = rc.Geometry.Point2d(conclusionsAreaXPos,targetBarYPos -targetGraphLabelHeight)
                targetGraphLabelFont = self.font
                arg.Display.Draw2dText(targetGraphLabelText,targetGraphLabelColor,targetGraphLabelPoint,targetGraphLabelMiddleJustification,targetGraphLabelHeight,targetGraphLabelFont)
                
                # DRAW TARGET ICONS ----------------------------------------------------------------------------------------------
                self.getDataQualityIcons()
                
                greenCheckiconPath = self.DataQualityIconDict.get("GreenCheck")
                greenCheckBitMap = rc.Display.DisplayBitmap.Load(greenCheckiconPath)
                
                redCheckiconPath = self.DataQualityIconDict.get("RedCheck")
                redCheckBitMap = rc.Display.DisplayBitmap.Load(redCheckiconPath)
                
                # draw sprites

                targetSpriteHeight = targetBarHeight
                targetSpriteWidth = targetBarHeight
                if GWPPerGFAPerYear <= (self.targetPerArea):
                    iconToDrawBitmap = greenCheckBitMap
                if GWPPerGFAPerYear > (self.targetPerArea):
                    iconToDrawBitmap = redCheckBitMap
                
                targetSpriteYPos = endOfTargetBarMidpointYPos
                targetSpriteXPos = endOfTargetBarMidpointXPos + gapBetweenDataBars + targetDataTextWidth + gapBetweenDataBars + targetSpriteWidth/2
                targetSpritePoint = rc.Geometry.Point2d(targetSpriteXPos,targetSpriteYPos)
                arg.Display.DrawSprite(iconToDrawBitmap,targetSpritePoint,targetSpriteHeight,targetSpriteWidth)
                
                # DRAW ERROR MESSAGE ICON ----------------------------------------------------------------------------------------------
                ra.WriteLine(str(len(self.errors)))
                        # Draw Icon
                if len(self.errors) > 0:
                    erroriconPath = self.DataQualityIconDict.get("Error")
                    errorBitMap = rc.Display.DisplayBitmap.Load(erroriconPath)
                    errorSpriteHeight = targetSpriteHeight
                    errorSpriteWidth = targetSpriteHeight
                    errorSpriteYPos = totalGWPperGFAYPos + (-1*totalGWPperGFAHeight) + targetSpriteHeight/2
                    for error in self.errors:
                        # Draw error icon
                        errorSpriteXPos = conclusionsAreaXPos + errorSpriteWidth/2
                        errorSpritePoint = rc.Geometry.Point2d(errorSpriteXPos,errorSpriteYPos)
                        arg.Display.DrawSprite(errorBitMap,errorSpritePoint,errorSpriteHeight,errorSpriteWidth)
                        # Draw error text
                        errorReportText = str(error)
                        errorReportColor = self.dark
                        errorReportXPos = conclusionsAreaXPos + errorSpriteWidth + gapBetweenDataBars
                        errorReportHeight = self.textHeight*1.2
                        errorReportYPos = errorSpriteYPos - errorReportHeight/3
                        errorReportPoint = rc.Geometry.Point2d(errorReportXPos,errorReportYPos)
                        errorReportMiddleJustification = False

                        errorReportFont = self.font
                        arg.Display.Draw2dText(errorReportText,errorReportColor,errorReportPoint,errorReportMiddleJustification,errorReportHeight,errorReportFont)
                        errorReportRectangle = arg.Display.Measure2dText(errorReportText,errorReportPoint,errorReportMiddleJustification,0,errorReportHeight,errorReportFont)
                        errorReportHeight = errorReportRectangle.Height
                        # Increment the Y Position
                        errorSpriteYPos += errorSpriteHeight
                
    def DrawViewportWires(self,arg):
        
        self.drawingWires = True
        
    def getLCAIcons(self):
        
        self.LCAIconDict = {
        "A1":r"L:\PROJECTS\BIGIDEAS_LCAToolDevelopment\07_GRAPHICS\210507_Icons\LCA-IconsJPEG\LCA-Icon__A1 - Raw material supply.png",
        "A1-A3":r"L:\PROJECTS\BIGIDEAS_LCAToolDevelopment\07_GRAPHICS\210507_Icons\LCA-IconsJPEG\LCA-Icon__A1 - Raw material supply.png",
        "A2":r"L:\PROJECTS\BIGIDEAS_LCAToolDevelopment\07_GRAPHICS\210507_Icons\LCA-IconsJPEG\LCA-Icon__A2 - Transport to factory.png",
        "A3":r"L:\PROJECTS\BIGIDEAS_LCAToolDevelopment\07_GRAPHICS\210507_Icons\LCA-IconsJPEG\LCA-Icon__A3 - Manufacture.png",
        "A4":r"L:\PROJECTS\BIGIDEAS_LCAToolDevelopment\07_GRAPHICS\210507_Icons\LCA-IconsJPEG\LCA-Icon__A4 - Transport to site.png",
        "A5":r"L:\PROJECTS\BIGIDEAS_LCAToolDevelopment\07_GRAPHICS\210507_Icons\LCA-IconsJPEG\LCA-Icon__A5 - Construction.png",
        "B1":r"L:\PROJECTS\BIGIDEAS_LCAToolDevelopment\07_GRAPHICS\210507_Icons\LCA-IconsJPEG\LCA-Icon__B1 - Use and off-gassing.png",
        "B2":r"L:\PROJECTS\BIGIDEAS_LCAToolDevelopment\07_GRAPHICS\210507_Icons\LCA-IconsJPEG\LCA-Icon__B2 - Maintenance.png",
        "B3":r"L:\PROJECTS\BIGIDEAS_LCAToolDevelopment\07_GRAPHICS\210507_Icons\LCA-IconsJPEG\LCA-Icon__B3 - Repair.png",
        "B4":r"L:\PROJECTS\BIGIDEAS_LCAToolDevelopment\07_GRAPHICS\210507_Icons\LCA-IconsJPEG\LCA-Icon__B4 - Replacement.png",
        "B5":r"L:\PROJECTS\BIGIDEAS_LCAToolDevelopment\07_GRAPHICS\210507_Icons\LCA-IconsJPEG\LCA-Icon__B5 - Refurbishment.png",
        "B6":r"L:\PROJECTS\BIGIDEAS_LCAToolDevelopment\07_GRAPHICS\210507_Icons\LCA-IconsJPEG\LCA-Icon__B6 - Operational energy.png",
        "B7":r"L:\PROJECTS\BIGIDEAS_LCAToolDevelopment\07_GRAPHICS\210507_Icons\LCA-IconsJPEG\LCA-Icon__B7 - Operational water.png",
        "C1":r"L:\PROJECTS\BIGIDEAS_LCAToolDevelopment\07_GRAPHICS\210507_Icons\LCA-IconsJPEG\LCA-Icon__C1 - Deconstruction.png",
        "C1-C4":r"L:\PROJECTS\BIGIDEAS_LCAToolDevelopment\07_GRAPHICS\210507_Icons\LCA-IconsJPEG\LCA-Icon__C1 - Deconstruction.png",
        "C2":r"L:\PROJECTS\BIGIDEAS_LCAToolDevelopment\07_GRAPHICS\210507_Icons\LCA-IconsJPEG\LCA-Icon__C2 - Transport off-site.png",
        "C3":r"L:\PROJECTS\BIGIDEAS_LCAToolDevelopment\07_GRAPHICS\210507_Icons\LCA-IconsJPEG\LCA-Icon__C3 - Waste processing.png",
        "C4":r"L:\PROJECTS\BIGIDEAS_LCAToolDevelopment\07_GRAPHICS\210507_Icons\LCA-IconsJPEG\LCA-Icon__C4 - Disposal.png",
        "D":r"L:\PROJECTS\BIGIDEAS_LCAToolDevelopment\07_GRAPHICS\210507_Icons\LCA-IconsJPEG\LCA-Icon__D1 - Reuse.png",
        "D1":r"L:\PROJECTS\BIGIDEAS_LCAToolDevelopment\07_GRAPHICS\210507_Icons\LCA-IconsJPEG\LCA-Icon__D1 - Reuse.png",
        "D2":r"L:\PROJECTS\BIGIDEAS_LCAToolDevelopment\07_GRAPHICS\210507_Icons\LCA-IconsJPEG\LCA-Icon__D2 - Recovery.png",
        "D3":r"L:\PROJECTS\BIGIDEAS_LCAToolDevelopment\07_GRAPHICS\210507_Icons\LCA-IconsJPEG\LCA-Icon__D3 - Recycling.png"
        }
        

    def getDataQualityIcons(self):
        self.DataQualityIconDict = {
        "GreenCheck" : r"L:\PROJECTS\BIGIDEAS_LCAToolDevelopment\07_GRAPHICS\210507_Icons\DataQualityIcons-JPEG\210607_BIGIDEAS_DataQualityIcons_v0_GreenCheck.png",
        "RedCheck" : r"L:\PROJECTS\BIGIDEAS_LCAToolDevelopment\07_GRAPHICS\210507_Icons\DataQualityIcons-JPEG\210607_BIGIDEAS_DataQualityIcons_v0_RedCheck.png",
        "Error" : r"L:\PROJECTS\BIGIDEAS_LCAToolDevelopment\07_GRAPHICS\210507_Icons\DataQualityIcons-JPEG\210607_BIGIDEAS_DataQualityIcons_v0_Error.png"
        }

    def getBIGSLogoIcon(self):
         self.getBIGSLogoIconDict = {
        "BIGSLogo" : r"L:\PROJECTS\BIGIDEAS_LCAToolDevelopment\07_GRAPHICS\210507_Icons\BIGSLogo\BIGsustainability.png"
        }

    def getLCAColors(self):
        

        self.LCAColors = {
        "A1-A3" : sd.Color.FromArgb(255, 47, 196, 238),
        "C1-C4" : sd.Color.FromArgb(255, 139, 34, 108),
        "A1" : sd.Color.FromArgb(255, 47, 196, 238),
        "A2" : sd.Color.FromArgb(255, 60, 170, 225),
        "A3" : sd.Color.FromArgb(255, 53, 140, 203),
        "A4" : sd.Color.FromArgb(255, 53, 119, 169),
        "A5" : sd.Color.FromArgb(255, 35, 98, 129),
        "B1" : sd.Color.FromArgb(255, 98, 48, 23),
        "B2" : sd.Color.FromArgb(255, 143, 48, 30),
        "B3" : sd.Color.FromArgb(255, 213, 49, 39),
        "B4" : sd.Color.FromArgb(255, 241, 95, 70),
        "B5" : sd.Color.FromArgb(255, 222, 166, 109),
        "B6" : sd.Color.FromArgb(255, 249, 157, 37),
        "B7" : sd.Color.FromArgb(255, 253, 219, 0),
        "C1" : sd.Color.FromArgb(255, 139, 34, 108),
        "C2" : sd.Color.FromArgb(255, 164, 96, 166),
        "C3" : sd.Color.FromArgb(255, 158, 123, 183),
        "C4" : sd.Color.FromArgb(255, 160, 149, 200),
        "D" : sd.Color.FromArgb(255, 55, 154, 70)
        }

    def __exit__(self):
        rc.Display.DisplayPipeline.DrawForeground -= self.DrawForeground
        
    def __enter__(self):
        rc.Display.DisplayPipeline.DrawForeground += self.DrawForeground
# ---------- end drawheadsupdisplay ----------

# ----
# Automatically Populates Lists Above
buildupcataloguestage3_4 = Data(buildupcataloguestage3_2)
parentlayerforallbuildups_2 = Text(parentlayerforallbuildups)
list_18 = ValueList({"Volume", "Area", "Length", "Count"}, selected="Count")
list_19 = ValueList({"Volume", "Area", "Length", "Count"}, selected="Length")
list_20 = ValueList({"Volume", "Area", "Length", "Count"}, selected="Area")
list_21 = ValueList({"Volume", "Area", "Length", "Count"}, selected="Volume")
buildupinputtype = Text(list_19)
buildupinputtype_2 = Text(list_18)
buildupinputtype_3 = Text(list_20)
buildupinputtype_4 = Text(list_21)
getnames = GhPythonScript(BuildupCatalogueStage2=buildupcataloguestage3_4, RequiredInputGeometryType=buildupinputtype_2)  # -> BuildupLookupNames
# ---------- getnames: Python ----------
buildupLookupNames = []
import Grasshopper as gh


if not BuildupCatalogueStage2:
    ghenv.Component.AddRuntimeMessage(gh.Kernel.GH_RuntimeMessageLevel.Warning, 'Please insert a valid BuildupCatalogueStage2')
if not RequiredInputGeometryType:
    ghenv.Component.AddRuntimeMessage(gh.Kernel.GH_RuntimeMessageLevel.Warning, 'Please specify RequiredInputGeometryType, allowed values are: Volume, Area, Length, Count')



if BuildupCatalogueStage2 and RequiredInputGeometryType:
    for k in BuildupCatalogueStage2['BuildupCatalogue'][RequiredInputGeometryType]:
        buildupLookupNames.append(k)
        
    BuildupLookupNames = sorted(buildupLookupNames)
    BuildupInputType = RequiredInputGeometryType
# ---------- end getnames ----------
getnames_2 = GhPythonScript(BuildupCatalogueStage2=buildupcataloguestage3_4, RequiredInputGeometryType=buildupinputtype)  # -> BuildupLookupNames; same code as getnames
getnames_3 = GhPythonScript(BuildupCatalogueStage2=buildupcataloguestage3_4, RequiredInputGeometryType=buildupinputtype_3)  # -> BuildupLookupNames
# ---------- getnames_3: Python ----------
buildupLookupNames = []
import Grasshopper as gh


if not BuildupCatalogueStage2:
    ghenv.Component.AddRuntimeMessage(gh.Kernel.GH_RuntimeMessageLevel.Warning, 'Please insert a valid BuildupCatalogueStage2')
if not RequiredInputGeometryType:
    ghenv.Component.AddRuntimeMessage(gh.Kernel.GH_RuntimeMessageLevel.Warning, 'Please specify RequiredInputGeometryType, allowed values are: Volume, Area, Length, Count')

print type(BuildupCatalogueStage2)

if BuildupCatalogueStage2 and RequiredInputGeometryType:
    for k in BuildupCatalogueStage2['BuildupCatalogue'][RequiredInputGeometryType]:
        buildupLookupNames.append(k)
        
    BuildupLookupNames = sorted(buildupLookupNames)
    BuildupInputType = RequiredInputGeometryType
# ---------- end getnames_3 ----------
getnames_4 = GhPythonScript(BuildupCatalogueStage2=buildupcataloguestage3_4, RequiredInputGeometryType=buildupinputtype_4)  # -> BuildupLookupNames
# ---------- getnames_4: Python ----------
buildupLookupNames = []
import Grasshopper as gh


if not BuildupCatalogueStage2:
    ghenv.Component.AddRuntimeMessage(gh.Kernel.GH_RuntimeMessageLevel.Warning, 'Please insert a valid BuildupCatalogueStage2')
if not RequiredInputGeometryType:
    ghenv.Component.AddRuntimeMessage(gh.Kernel.GH_RuntimeMessageLevel.Warning, 'Please specify RequiredInputGeometryType, allowed values are: Volume, Area, Length, Count')

if BuildupCatalogueStage2 and RequiredInputGeometryType:
    for k in BuildupCatalogueStage2['BuildupCatalogue'][RequiredInputGeometryType]:
        buildupLookupNames.append(k)
        
    BuildupLookupNames = sorted(buildupLookupNames)
    BuildupInputType = RequiredInputGeometryType
# ---------- end getnames_4 ----------
valuelist_name = Panel("RhinoLayerName")
builduplookupnames = Text(getnames)
builduplookupnames_2 = Text(getnames_2)
builduplookupnames_3 = Text(getnames_3)
builduplookupnames_4 = Text(getnames_4)

# ---- group: Get Geometry on Rhino Layer. Dynamically recomputes on changes in Rhino document.
gcn = GetChildNames(ParentLayerName=parentlayerforallbuildups_2)  # -> ChildLayerNames; inputs LayersToExclude: list
# ---------- gcn: Python ----------
"""
Get names of all child layers. Dynamically recomputes on changes in Rhino document.
    Inputs:
        Layer: Name of Rhino layer to get Geometry from {item,str}
    Outputs:
        Geometry: Geometry that is on Rhino Layer {list,geometry}
    Remarks:
        Author: Anders Holden Deleuran (BIG IDEAS)
        Editor: Alexander Matthias Jacobson (BIG S)
        Rhino: 7.12.21299.13001
        Version: 211028
"""

ghenv.Component.Name = "GetChildNames"
ghenv.Component.NickName = "GCN"

import Rhino as rc
from ghpythonlib.componentbase import executingcomponent as component
import rhinoscriptsyntax as rs
import scriptcontext as sc
import time

class GetRhinoGeometry(component):
    
    runs = 0
    
    def RunScript(self, ParentLayerName, LayersToExclude):
        
        print 'test'
        ChildLayers = []
        #Set the Rhino document as the active document
        sc.doc = rc.RhinoDoc.ActiveDoc
        
        if "log" not in sc.sticky:
            sc.sticky["log"] = []
        
        if "scheduleCallbackToExpireSolution" not in sc.sticky:
            sc.sticky["scheduleCallbackToExpireSolution"] = False
        
        sc.sticky["log"] += ['Listener at beginning sees scheduleCallbackToExpireSolution as: ' + str(sc.sticky["scheduleCallbackToExpireSolution"])]
        print sc.sticky["log"]
        sortedList = []
        dict = {}
        # Get the parentLayer object from the Rhino Layer table
        if ParentLayerName and sc.sticky["scheduleCallbackToExpireSolution"] == True:
            self.runs += 1
            self.Message = "Recomputes: " + str(self.runs)
            layerTableIndex = rc.RhinoDoc.ActiveDoc.Layers.FindByFullPath(ParentLayerName, None)
            parentLayer = rc.RhinoDoc.ActiveDoc.Layers[layerTableIndex]
            childLayers = parentLayer.GetChildren()
            if childLayers:
            #Iterate over the child layers, and add the names to the list.
                for childLayer in childLayers:
                    excludeChild = False
                    for excludedName in LayersToExclude:
                        if childLayer.Name == excludedName:
                            excludeChild = True
                    if excludeChild == False:
                        #get index of layer
                        layerIndex = rc.RhinoDoc.ActiveDoc.Layers[childLayer.LayerIndex]
                        #get name of layer as str
                        layerName = str(layerIndex)
                        #get order number of layer (not same as index)
                        orderNumber = rs.LayerOrder(layerName)
                        #Save order number to layer name as key-value pair to dict
                        dict[childLayer.Name] = orderNumber
        
        #Sort key-value items in dictionary by value (order number) and add key to sorted list
        #The key in this dictionary is the childname
        for key, value in sorted(dict.items(), key=lambda item: item[1]):
            sortedList.append(key)
        ChildLayerNames = sortedList
        return ChildLayerNames
        sc.doc = ghdoc
        
    def callBack(self,e):
        self.ExpireSolution(False)
        
    def updateComponent(self,sender,e):
        sc.sticky["log"] += ['updateComponent method was called.']
        sc.sticky["log"] += ['updateComponent read scheduleCallbackToExpireSolution read as: ' + str(sc.sticky["scheduleCallbackToExpireSolution"])]
        if sc.sticky["scheduleCallbackToExpireSolution"] == True:
            sc.sticky["log"] += ['A callback was scheduled to expire the solution.']
            self.OnPingDocument().ScheduleSolution(1,self.callBack)
            
    def __enter__(self):
        rc.RhinoDoc.AddRhinoObject += self.updateComponent
        rc.RhinoDoc.DeleteRhinoObject += self.updateComponent
        rc.RhinoDoc.UndeleteRhinoObject += self.updateComponent
        rc.RhinoDoc.ModifyObjectAttributes += self.updateComponent
        rc.RhinoDoc.LayerTableEvent += self.updateComponent
        
    def __exit__(self):
        rc.RhinoDoc.AddRhinoObject -= self.updateComponent
        rc.RhinoDoc.DeleteRhinoObject -= self.updateComponent
        rc.RhinoDoc.UndeleteRhinoObject -= self.updateComponent
        rc.RhinoDoc.ModifyObjectAttributes -= self.updateComponent
        rc.RhinoDoc.LayerTableEvent -= self.updateComponent
# ---------- end gcn ----------

# ----
data = Data(gcn)

# ---- group: Auto-Fill BuildupLookupNames
valuelist_name_2 = Panel("Length-Based-Buildups")
data_2 = Data(builduplookupnames_2)

valuelist_name_3 = Panel("Count-Based-Buildups")
data_3 = Data(builduplookupnames)

# ---- group: Populate Value List
pvl = PopulateValueList(Name=valuelist_name, Keys=data, Values=data)  # inputs Keys: list, Values: list
# ---------- pvl: Python ----------
"""
Populate Value List
    Inputs:
        Name: {item,str}
        Keys: {list,str}
        Values: {list,str}
    Outputs:
    Remarks:
        Author: Anders Holden Deleuran (BIG IDEAS)
        Rhino: 6.30.20266.14531
        Version: 210108
"""
import pprint
import scriptcontext as sc 

ghenv.Component.Name = "PopulateValueList"
ghenv.Component.NickName = "PVL"

import Grasshopper as gh

if Keys and Values:
    for obj in ghenv.Component.OnPingDocument().Objects:
        if type(obj) is gh.Kernel.Special.GH_ValueList:
            if obj.NickName == Name:
                if obj.ListItems.Count:
                    selected = obj.FirstSelectedItem.Name
                else:
                    selected = None
                obj.ListItems.Clear()
                for k,v in zip(Keys,Values):
                    sc.sticky["log"] += ['Appended new layer names to ValueList: ' + str(k)]
                    vli = gh.Kernel.Special.GH_ValueListItem(str(k),str('"' + v + '"'))
                    obj.ListItems.Add(vli)
                if selected in Keys:
                    obj.SelectItem(Keys.index(selected))
                obj.ExpireSolution(True)
# ---------- end pvl ----------
# ---- group: Auto-Fill BuildupLookupNames
valuelist_name_4 = Panel("Area-Based-Buildups")
data_4 = Data(builduplookupnames_3)

valuelist_name_5 = Panel("Volume-Based-Buildups")
data_5 = Data(builduplookupnames_4)

# ---- group: Auto-Fill BuildupLookupNames / Populate Value List
pvl_2 = PopulateValueList(Name=valuelist_name_3, Keys=data_3, Values=data_3)  # inputs Keys: list, Values: list
# ---------- pvl_2: Python ----------
"""
Populate Value List
    Inputs:
        Name: {item,str}
        Keys: {list,str}
        Values: {list,str}
    Outputs:
    Remarks:
        Author: Anders Holden Deleuran (BIG IDEAS)
        Edited: Alexander Matthias Jacobson
        Rhino: 7.14.22010.17001
        Version: 220303
        VersionNotes:
            Added input verification
"""
import pprint

ghenv.Component.Name = "PopulateValueList"
ghenv.Component.NickName = "PVL"

import Grasshopper as gh

allInputsOk = True
for k in Keys:
    if k is None:
        allInputsOk = False
for v in Values:
    if v is None:
        allInputsOk = False

if allInputsOk == False:
        ghenv.Component.AddRuntimeMessage(gh.Kernel.GH_RuntimeMessageLevel.Warning, 'At least one key or value is None')

if allInputsOk:
    for obj in ghenv.Component.OnPingDocument().Objects:
        if type(obj) is gh.Kernel.Special.GH_ValueList:
            if obj.NickName == Name:
                if obj.ListItems.Count:
                    selected = obj.FirstSelectedItem.Name
                else:
                    selected = None
                obj.ListItems.Clear()
                for k,v in zip(Keys,Values):
                    vli = gh.Kernel.Special.GH_ValueListItem(str(k),str('"' + v + '"'))
                    obj.ListItems.Add(vli)
                if selected in Keys:
                    obj.SelectItem(Keys.index(selected))
                obj.ExpireSolution(True)
# ---------- end pvl_2 ----------

pvl_3 = PopulateValueList(Name=valuelist_name_2, Keys=data_2, Values=data_2)  # inputs Keys: list, Values: list; same code as pvl_2

pvl_4 = PopulateValueList(Name=valuelist_name_4, Keys=data_4, Values=data_4)  # inputs Keys: list, Values: list; same code as pvl_2

pvl_5 = PopulateValueList(Name=valuelist_name_5, Keys=data_5, Values=data_5)  # inputs Keys: list, Values: list; same code as pvl_2
